# Grasshopper definition puerto_rico.gh (Grasshopper 1.0.7)
# plug-ins: Human

external_ring_height_2_m = Slider(5, range=0..10)
ring_num_edges = Slider(8, range=0..10)
inner_ring_diameter_m = Slider(2.5, range=0..10)
outer_ring_diameter_m = Slider(25, range=0..100)
inner_ring_diameter_m_2 = Slider(6, range=0..10)
num_sub_v = Slider(15, range=0..100)
num_subd_w = Slider(3, range=0..100)
num_subd_u = Slider(5, range=0..100)
external_ring_height_m = Slider(2.5, range=0..10)
pt = ConstructPoint(XCoordinate=0, YCoordinate=0, ZCoordinate=0)
num = Number(num_sub_v)
num_2 = Number(num_subd_w)
entwine = Entwine(Branch00=inner_ring_diameter_m, Branch01=outer_ring_diameter_m, FlattenInputs=True)
num_3 = Number(num_subd_u)
num_4 = Number(external_ring_height_m)
num_5 = Number(ring_num_edges)
num_6 = Number(inner_ring_diameter_m_2)
num_7 = Number(external_ring_height_2_m)
pt_2 = Point(pt)
num_8 = Number(entwine)
num_9 = Number(inner_ring_diameter_m)
python = GhPythonScript(unload=Button())  # -> out, a; inputs unload: Boolean
# ---------- python: Python ----------
from compas_ghpython import unload_modules


modules = ['compas', 'compas_ghpython', 'compas_fofin']
if unload:
    for module in modules:
        unload_modules(module)
# ---------- end python ----------
pt_3 = Point(pt_2)
num_10 = Number(Slider(0, range=0..10))
panel = Panel(python.out)
num_11 = Number(num_8)
pt_4 = Point(pt_2)
num_12 = Number(num_5)
num_13 = Number(num_9)
num_14 = Number(num_5)
num_15 = Number(num_6)
pt_5 = Point(pt_2)
neg = Negative(Value=num_10)
division = Division(A=num_11, B=2)
Y = UnitY(Factor=neg)
division_2 = Division(A=num_13, B=2)
division_3 = Division(A=num_15, B=2)
move = Move(Geometry=pt_3, Motion=Y)  # -> Geometry, Transform
ellipse = Ellipse(Plane=pt_5, Radius1=division_2, Radius2=division_3)  # -> Ellipse, Focus1, Focus2
polygon = Polygon(Plane=pt_4, Radius=division, Segments=num_12, FilletRadius=0)  # -> Polygon, Length
divide = DivideCurve(Curve=ellipse.Ellipse, Count=num_14, Kinks=False)  # -> Points, Tangents, Parameters
crv = Curve(polygon.Polygon)
rectangle = Rectangle(Plane=move.Geometry, XSize="-1.25 to 1.25", YSize="-3.0 to 3.0", Radius=0)  # -> Rectangle, Length
pline = PolyLine(Vertices=divide.Points, Closed=True)
Z = UnitZ(Factor="-2.5")
extr = Extrude(Base=rectangle.Rectangle, Direction=Z)
crv_2 = Curve(pline)
cap = CapHoles(Brep=extr)
brep = Brep(cap)
crv_3 = Curve(crv_2)
crv_4 = Curve(crv)
bang = ExplodeTree(Data=crv_4)  # -> Branch0, Branch1
brep_2 = Brep(brep)
preview = CustomPreview(Geometry=brep_2, Material=ColourSwatch(SwatchColor=RGB(255, 255, 255)))
num_16 = Number(Slider(0.25, range=0..1))
entwine_2 = Entwine(Branch00=crv_3, Branch01=bang.Branch1, FlattenInputs=True)
num_17 = Number(Slider(0.25, range=0..1))
crv_5 = Curve(entwine_2)
num_18 = Number(num_5)
num_19 = Number(num_4)
num_20 = Number(num_7)
crv_6 = Curve(crv_5)
subtraction = Subtraction(A=num_18, B=1)
range = Range(Domain=Domain(0, 1), Steps=subtraction)
dom = ConstructDomain(DomainStart=num_19, DomainEnd=num_20)
explode = Explode(Curve=crv_6, Recursive=True)  # -> Segments, Vertices
graph = GraphMapper(range, x0=0, x1=1, y0=0, y1=1, container_name="Gaussian", factor=0.2, mean=0.5, sdev=0.1)
num_21 = Number(num_17)
cullpt = CullDuplicates(Points=explode.Vertices, Tolerance=0.1, CullMode=3)  # -> Points, Indices, Valence
remap = RemapNumbers(Value=graph, Source=Domain(0, 1), Target=dom)  # -> Mapped, Clipped
entwine_3 = Entwine(Branch00="0.0", Branch01=remap.Mapped, FlattenInputs=True)
Z_2 = UnitZ(Factor=entwine_3)
subtraction_2 = Subtraction(A=num_21, B=1)
num_22 = Number(num_16)
move_2 = Move(Geometry=cullpt.Points, Motion=Z_2)  # -> Geometry, Transform
abs = Absolute(Value=subtraction_2)
avr = Average(Input=[num_21, abs])
pline_2 = PolyLine(Vertices=move_2.Geometry, Closed="TRue")
panel_2 = Panel("1.0")
entwine_4 = Entwine(Branch00="0", Branch01=num_21, Branch02=avr, Branch03=abs, FlattenInputs=True)  # -> flatten(Result)
crv_7 = Curve(pline_2)
crv_8 = Curve(crv_7)
explode_2 = Explode(Curve=crv_8, Recursive=True)  # -> Segments, Vertices
cullpt_2 = CullDuplicates(Points=explode_2.Vertices, Tolerance=0.1, CullMode=1)  # -> Points, Indices, Valence
flip = FlipMatrix(Data=cullpt_2.Points)
pline_3 = PolyLine(Vertices=flip, Closed=False)
crv_9 = Curve(pline_3)
crv_10 = Curve(explode_2.Segments)
crv_11 = Curve(crv_9)
crv_12 = Curve(crv_9)
flip_2 = FlipCurve(Curve=crv_12)  # -> Curve, Flag
end = EndPoints(Curve=crv_11)  # -> Start, End
eval = EvaluateCurve(Curve=reparameterize(flip_2.Curve), Parameter=num_22)  # -> Point, Tangent, Angle
num_23 = Number(num_3)
crv_13 = Curve(crv_7)
num_24 = Number(entwine_4)
pt_6 = Point(eval.Point)
pt_7 = Point(end.End)
explode_3 = Explode(Curve=crv_13, Recursive=True)  # -> Segments, Vertices
crv_14 = Curve(crv_10)
num_25 = Number(num_24)
graft = GraftTree(Tree=crv_14, IncludeEmptyLists=True, IncludeNullItems=True)
flip_3 = FlipMatrix(Data=explode_3.Segments)
eval_2 = EvaluateCurve(Curve=reparameterize(graft), Parameter=num_25)  # -> Point, Tangent, Angle
divide_2 = DivideCurve(Curve=flip_3, Count=num_23, Kinks=False)  # -> simplify(Points), Tangents, Parameters
pt_8 = Point(eval_2.Point)
graft_2 = GraftTree(Tree=divide_2.Points, IncludeEmptyLists=True, IncludeNullItems=True)
pt_9 = Point(pt_7)
pt_10 = Point(simplify(pt_8))
path_mapper = PathMapper(graft_2, source="{A;B;C}", target="{A;C}")
pt_11 = Point(simplify(pt_8))
pt_12 = Point(pt_6)
split = SplitTree(Data=pt_10, Masks=flatten("{0;*}"))  # -> Positive, Negative
flatten = FlattenTree(Tree=pt_9, Path="{0}")
split_2 = SplitTree(Data=pt_11, Masks=flatten("{0;*}"))  # -> Positive, Negative
pline_4 = PolyLine(Vertices=path_mapper, Closed=False)
shift = ShiftList(List=flatten, Shift=1, Wrap=True)
item = ListItem(List=split.Negative, Index=0, Wrap=True)  # -> Item1, Item, Item1_2
pt_13 = Point(explode_3.Vertices)
replace = ReplaceItems(List=split_2.Negative, Item=pt_12, Indices="0", Wrap=False)
graft_3 = GraftTree(Tree=shift, IncludeEmptyLists=True, IncludeNullItems=True)
crv_15 = Curve(pline_4)
pt_14 = Point(explode_3.Vertices)
pt_15 = Point(replace)
pt_16 = Point(split_2.Positive)
ln = Line(StartPoint=pt_9, EndPoint=item.Item1_2)
ln_2 = Line(StartPoint=graft_3, EndPoint=item.Item1)
crv_16 = Curve(crv_15)
num_26 = Number(num)
pt_17 = Point(pt_15)
pt_18 = Point(pt_16)
entwine_5 = Entwine(Branch00=ln, Branch01=ln_2, FlattenInputs=True)
divide_3 = DivideCurve(Curve=crv_16, Count=num_26, Kinks=False)  # -> simplify(Points), Tangents, Parameters
flatten_2 = FlattenTree(Tree=pt_17, Path="{0}")
flatten_3 = FlattenTree(Tree=pt_18, Path="{0}")
flatten_4 = FlattenTree(Tree=entwine_5, Path="{0}")
pline_5 = PolyLine(Vertices=flatten_2, Closed="True")
pline_6 = PolyLine(Vertices=flatten_3, Closed="True")
graft_4 = GraftTree(Tree=divide_3.Points, IncludeEmptyLists=True, IncludeNullItems=True)
crv_17 = Curve(flatten_4)
explode_4 = Explode(Curve=pline_5, Recursive=True)  # -> Segments, Vertices
explode_5 = Explode(Curve=pline_6, Recursive=True)  # -> Segments, Vertices
path_mapper_2 = PathMapper(graft_4, source="{A;B;C}", target="{A;C}")
ln_3 = Line(StartPoint=explode_5.Vertices, EndPoint=explode_4.Vertices)
pline_7 = PolyLine(Vertices=divide_3.Points, Closed=False)
pline_8 = PolyLine(Vertices=path_mapper_2, Closed=False)
crv_18 = Curve(explode_5.Segments)
crv_19 = Curve(explode_4.Segments)
num_27 = Number(num_2)
crv_20 = Curve(ln_3)
explode_6 = Explode(Curve=pline_7, Recursive=True)  # -> Segments, Vertices
explode_7 = Explode(Curve=pline_8, Recursive=True)  # -> Segments, Vertices
crv_21 = Curve(explode_5.Segments)
crv_22 = Curve(explode_4.Segments)
entwine_6 = Entwine(Branch00=crv_21, Branch01=crv_22, FlattenInputs=True)
crv_23 = Curve(explode_6.Segments)
crv_24 = Curve(explode_7.Segments)
divide_4 = DivideCurve(Curve=entwine_6, Count=num_27, Kinks=False)  # -> simplify(Points), Tangents, Parameters
graft_5 = GraftTree(Tree=divide_4.Points, IncludeEmptyLists=True, IncludeNullItems=True)
path_mapper_3 = PathMapper(graft_5, source="{A;B;C}", target="{C; B}")
crv_25 = Curve(crv_23)
crv_26 = Curve(crv_24)
merge = Merge(Data1=crv_25, Data2=crv_26)
pline_9 = PolyLine(Vertices=path_mapper_3, Closed=False)
flatten_5 = FlattenTree(Tree=merge, Path="{0}")
explode_8 = Explode(Curve=pline_9, Recursive=True)  # -> simplify(Segments), Vertices
crv_27 = Curve(flatten_5)
crv_28 = Curve(explode_8.Segments)
pt_19 = Point(pt_14)
crv_29 = Curve(crv_27)
flatten_6 = FlattenTree(Tree=pt_19, Path="{0}")
crv_30 = Curve(crv_28)
num_28 = Number(num)
python_2 = GhPythonScript(lines=crv_29, anchors=flatten_6)  # -> out, vertices, edges, faces, reactions, stresses, forces; inputs lines: list, anchors: list; disabled
# ---------- python_2: Python ----------
#!/usr/bin/env python
# -*- coding: utf-8 -*-

import os
import compas
import Rhino
import rhinoscriptsyntax as rs

from compas.datastructures import Mesh
from compas.utilities import Colormap
from compas.utilities import geometric_key

from compas_fofin.datastructures import Cablenet
from compas_fofin.analysis import mesh_materialize_cables

from compas_fofin.fofin import update_xyz_proxy
from compas.rpc import Proxy
import compas_fofin.fofin

from compas_rhino.utilities import get_line_coordinates
from compas_rhino.utilities import get_point_coordinates

from compas_rhino.selectors import EdgeSelector
from compas_rhino.selectors import VertexSelector

from compas_fofin.rhino import CablenetArtist

from compas.geometry import angle_vectors
from compas.geometry import dot_vectors

from compas_ghpython.artists import MeshArtist

import scriptcontext as sc

def edges_where_midpoints_in_rh_lines(struct, lines):
	lines = {geometric_key(rs.CurveMidPoint(line)): line for line in lines}
	edges = {geometric_key(struct.edge_midpoint(u, v)): (u, v) for u, v in struct.edges()}
	for gkey, ekey in edges.items():
		if lines.get(gkey) is not None:
			yield ekey

# ==============================================================================
# Call Proxy Locally
# ==============================================================================

fofin = sc.sticky['fofin']

# ==============================================================================
# Files IO
# ==============================================================================

# HERE = os.path.dirname(__file__)
# FILE_I = os.path.join(HERE, 'lines.json')
# FILE_O = os.path.join(HERE, 'hypar.json')

# ==============================================================================
# Create a cablenet from Rhino
# ==============================================================================

cablenet = Cablenet.from_lines(get_line_coordinates(lines), True)

# ==============================================================================
# Create a cablenet from Rhino
# ==============================================================================

max_num_vertices = 4
deletable = set()
for fkey in cablenet.faces():
    if len(cablenet.face_vertices(fkey)) <= max_num_vertices:
        continue
    
    deletable.add(fkey)

print('deletable ', len(deletable))
for fkey in deletable:
    cablenet.delete_face(fkey)
    
# ==============================================================================
# Set material density for self-weight
# ==============================================================================

cablenet.attributes['density'] = 0.

# ==============================================================================
# Set and move anchors
# ==============================================================================

gkey_key = cablenet.gkey_key()
for xyz in get_point_coordinates(anchors):
	vkey = gkey_key[geometric_key(xyz)]
	cablenet.vertex_attributes(vkey, ['is_anchor', 'is_fixed'], [True, True])
    
# ==============================================================================
# Change Force Densities
# ==============================================================================

# for edge in cablenet.edges_on_boundary():
# 	cablenet.edge_attributes(edge, ['q'], [2.0])

# count = 0
# for edge in cablenet.edges():
# 	edge_vec = cablenet.edge_vector(*edge)
	# if angle_vectors([1.0, 0.0, 0.0], edge_vec, deg=True) > 90:
	# if dot_vectors([1.0, 0.0, 0.0], edge_vec) <= 0.0:
	# 	cablenet.edge_attributes(edge, ['q'], [2.0])
	# 	count += 1

# count = 0
# for edge in edges_where_midpoints_in_rh_lines(cablenet, rh_edges_3):
# 	cablenet.edge_attributes(edge, ['q'], [4.0])
#  	count += 1

# for edge in edges_where_midpoints_in_rh_lines(cablenet, rh_edges_1):
# 	cablenet.edge_attributes(edge, ['q'], [1.0])

# for edge in edges_where_midpoints_in_rh_lines(cablenet, rh_edges_4):
# 	cablenet.edge_attributes(edge, ['q'], [1.0])

# ==============================================================================
# Apply point loads
# ==============================================================================

# for xyz in get_point_coordinates(rh_point_loads):
# 	vkey = gkey_key[geometric_key(xyz)]
# 	cablenet.vertex_attributes(vkey, ['py'], [0.6])

# ==============================================================================
# Compute equilibrium with Proxy
# ==============================================================================

data = fofin.update_xyz_proxy(cablenet.to_data())
cablenet = Cablenet.from_data(data)

# ==============================================================================
# Assign radius to cables
# ==============================================================================

mesh_materialize_cables(cablenet)

# ==============================================================================
# Change scriptcontext doc
# ==============================================================================

sc.doc = Rhino.RhinoDoc.ActiveDoc

# ==============================================================================
# Visualize
# ==============================================================================

# heights = cablenet.vertices_attribute('z')
# cmap = Colormap(heights, 'black')
# vertexcolor = {key: cmap(z) for key, z in zip(cablenet.vertices(), heights)}

# forces = cablenet.edges_attribute('f')
# cmap = Colormap(forces, 'rgb')
# edgecolor = {key: cmap(f) for key, f in zip(cablenet.edges(), forces)}


# artist = MeshArtist(cablenet)
artist = CablenetArtist(cablenet, layer='cablenet')
artist.clear_layer()

vertices = artist.draw_vertices()
edges = artist.draw_edges()
faces = artist.draw_faces()

# reactions = artist.draw_reactions()
# forces = artist.draw_forces(scale=0.05)
# stresses = artist.draw_stress(0.025)

artist.redraw()

# ==============================================================================
# Restore scriptcontext doc
# ==============================================================================

sc.doc = ghdoc

# ==============================================================================
# Export
# ==============================================================================

# cablenet.to_json(FILE_O)
# ---------- end python_2 ----------
divide_5 = DivideCurve(Curve=crv_30, Count=num_28, Kinks=False)  # -> simplify(Points), Tangents, Parameters
crv_31 = Curve(python_2.edges)
path_mapper_4 = PathMapper(divide_5.Points, source="{A;B}", target="{B; A}")
mesh = Mesh(python_2.faces)
geo = Geometry(python_2.stresses)
geo_2 = Geometry(python_2.reactions)
geo_3 = Geometry(python_2.forces)
pline_10 = PolyLine(Vertices=divide_5.Points, Closed=False)
panel_3 = Panel(python_2.out)
graft_6 = GraftTree(Tree=path_mapper_4, IncludeEmptyLists=True, IncludeNullItems=True)
explode_9 = Explode(Curve=pline_10, Recursive=True)  # -> Segments, Vertices
path_mapper_5 = PathMapper(graft_6, source="{A;B;C}", target="{C}")
mesh_2 = Mesh(mesh)
crv_32 = Curve(explode_9.Segments)
pline_11 = PolyLine(Vertices=path_mapper_5, Closed=False)
preview_2 = CustomPreview(Geometry=mesh_2, Material=ColourSwatch(SwatchColor=RGB(204, 204, 204)))
explode_10 = Explode(Curve=pline_11, Recursive=True)  # -> flatten(Segments), Vertices
crv_33 = Curve(explode_10.Segments)
crv_34 = Curve(crv_17)
crv_35 = Curve(crv_32)
crv_36 = Curve(crv_33)
merge_2 = Merge(Data1=crv_35, Data2=crv_36, Data3=crv_34)
flatten_7 = FlattenTree(Tree=merge_2, Path="{0}")
crv_37 = Curve(flatten_7)
python_3 = GhPythonScript(run_proxy=Toggle(True), stop_server=Toggle(False))  # -> out, a; inputs run_proxy: Boolean, stop_server: Boolean
# ---------- python_3: Python ----------
from compas.rpc import Proxy
import scriptcontext as sc

import compas_fofin.fofin

if run_proxy:
    proxy = Proxy('compas_fofin.fofin')
    sc.sticky['fofin'] = proxy
    
    if stop_server:
        proxy.stop_server()
# ---------- end python_3 ----------
num_29 = Number(Slider(1, range=0..10))
num_30 = Number(Slider(10, range=0..10))
pt_20 = Point(pt_14)
crv_38 = Curve(crv_37)
panel_4 = Panel(python_3.out)
num_31 = Number(num_29)
num_32 = Number(num_30)
flatten_8 = FlattenTree(Tree=pt_20, Path="{0}")
python_4 = GhPythonScript(lines=crv_38, anchors=flatten_8, q_boundary=num_31, q_boundary_2=num_32)  # -> out, vertices, edges, faces, reactions, stresses, forces, cablenet; inputs lines: list, anchors: list
# ---------- python_4: Python ----------
#!/usr/bin/env python
# -*- coding: utf-8 -*-

import os
import math
import compas
import Rhino
import rhinoscriptsyntax as rs

from compas.datastructures import Mesh
from compas.utilities import Colormap
from compas.utilities import geometric_key

from compas_fofin.datastructures import Cablenet
from compas_fofin.analysis import mesh_materialize_cables

from compas_fofin.fofin import update_xyz_proxy
from compas.rpc import Proxy
import compas_fofin.fofin

from compas_rhino.utilities import get_line_coordinates
from compas_rhino.utilities import get_point_coordinates

from compas_rhino.selectors import EdgeSelector
from compas_rhino.selectors import VertexSelector

from compas_fofin.rhino import CablenetArtist

from compas.geometry import angle_vectors
from compas.geometry import dot_vectors
from compas.geometry import distance_point_point

from compas_ghpython.artists import MeshArtist

import scriptcontext as sc

def edges_where_midpoints_in_rh_lines(struct, lines):
	lines = {geometric_key(rs.CurveMidPoint(line)): line for line in lines}
	edges = {geometric_key(struct.edge_midpoint(u, v)): (u, v) for u, v in struct.edges()}
	for gkey, ekey in edges.items():
		if lines.get(gkey) is not None:
			yield ekey

# ==============================================================================
# Call Proxy Locally
# ==============================================================================

fofin = sc.sticky['fofin']

# ==============================================================================
# Files IO
# ==============================================================================

# HERE = os.path.dirname(__file__)
# FILE_I = os.path.join(HERE, 'lines.json')
# FILE_O = os.path.join(HERE, 'hypar.json')

# ==============================================================================
# Create a cablenet from Rhino
# ==============================================================================

cablenet = Cablenet.from_lines(get_line_coordinates(lines), True)

# ==============================================================================
# Create a cablenet from Rhino
# ==============================================================================

max_num_vertices = 4
deletable = set()
for fkey in cablenet.faces():
    if distance_point_point(cablenet.face_centroid(fkey), [0, 0, 0]) > 0.10:
    # if len(cablenet.face_vertices(fkey)) <= max_num_vertices:
        continue
    
    deletable.add(fkey)

print('deletable ', len(deletable))
for fkey in deletable:
    cablenet.delete_face(fkey)
    
# ==============================================================================
# Set material density for self-weight
# ==============================================================================

cablenet.attributes['density'] = 0.

# ==============================================================================
# Set and move anchors
# ==============================================================================

gkey_key = cablenet.gkey_key()
for xyz in get_point_coordinates(anchors):
	vkey = gkey_key[geometric_key(xyz)]
	cablenet.vertex_attributes(vkey, ['is_anchor', 'is_fixed'], [True, True])
    
# ==============================================================================
# Change Force Densities
# ==============================================================================

# z_coords = list(cablenet.vertices_attribute('z'))
z_coords = [cablenet.edge_midpoint(u, v)[2] for u, v in cablenet.edges()]
z_max = max(z_coords)
z_min = min(z_coords)

for edge in cablenet.edges_on_boundary():
    if math.fabs(cablenet.edge_midpoint(*edge)[2] - z_max) <= 0.01:
        cablenet.edge_attributes(edge, ['q'], [q_boundary])
    elif math.fabs(cablenet.edge_midpoint(*edge)[2] - z_min) <= 0.01:
        cablenet.edge_attributes(edge, ['q'], [q_boundary_2])
        print('it is in 2')
       
# count = 0
# for edge in cablenet.edges():
# 	edge_vec = cablenet.edge_vector(*edge)
	# if angle_vectors([1.0, 0.0, 0.0], edge_vec, deg=True) > 90:
	# if dot_vectors([1.0, 0.0, 0.0], edge_vec) <= 0.0:
	# 	cablenet.edge_attributes(edge, ['q'], [2.0])
	# 	count += 1

# count = 0
# for edge in edges_where_midpoints_in_rh_lines(cablenet, rh_edges_3):
# 	cablenet.edge_attributes(edge, ['q'], [4.0])
#  	count += 1

# for edge in edges_where_midpoints_in_rh_lines(cablenet, rh_edges_1):
# 	cablenet.edge_attributes(edge, ['q'], [1.0])

# for edge in edges_where_midpoints_in_rh_lines(cablenet, rh_edges_4):
# 	cablenet.edge_attributes(edge, ['q'], [1.0])

# ==============================================================================
# Apply point loads
# ==============================================================================

# for xyz in get_point_coordinates(rh_point_loads):
# 	vkey = gkey_key[geometric_key(xyz)]
# 	cablenet.vertex_attributes(vkey, ['py'], [0.6])

# ==============================================================================
# Compute equilibrium with Proxy
# ==============================================================================

data = fofin.update_xyz_proxy(cablenet.to_data())
cablenet = Cablenet.from_data(data)

# ==============================================================================
# Assign radius to cables
# ==============================================================================

mesh_materialize_cables(cablenet)

# ==============================================================================
# Change scriptcontext doc
# ==============================================================================

sc.doc = Rhino.RhinoDoc.ActiveDoc

# ==============================================================================
# Visualize
# ==============================================================================

# heights = cablenet.vertices_attribute('z')
# cmap = Colormap(heights, 'black')
# vertexcolor = {key: cmap(z) for key, z in zip(cablenet.vertices(), heights)}

# forces = cablenet.edges_attribute('f')
# cmap = Colormap(forces, 'rgb')
# edgecolor = {key: cmap(f) for key, f in zip(cablenet.edges(), forces)}


# artist = MeshArtist(cablenet)
artist = CablenetArtist(cablenet, layer='cablenet')
artist.clear_layer()

vertices = artist.draw_vertices()
edges = artist.draw_edges()
faces = artist.draw_faces()

# reactions = artist.draw_reactions()
# forces = artist.draw_forces(scale=0.05)
# stresses = artist.draw_stress(0.025)

artist.redraw()

# ==============================================================================
# Restore scriptcontext doc
# ==============================================================================

sc.doc = ghdoc

# ==============================================================================
# Export
# ==============================================================================

# cablenet.to_json(FILE_O)
# ---------- end python_4 ----------
crv_39 = Curve(python_4.edges)
mesh_3 = Mesh(python_4.faces)
geo_4 = Geometry(python_4.stresses)
geo_5 = Geometry(python_4.reactions)
geo_6 = Geometry(python_4.forces)
data = Data(python_4.cablenet)
panel_5 = Panel(python_4.out)
mesh_4 = Mesh(mesh_3)
crv_40 = Curve(crv_39)
data_2 = Data(data)
python_5 = GhPythonScript(cablenet=data_2)  # -> out, forces, radius
# ---------- python_5: Python ----------
forces = list(cablenet.edges_attribute('f'))
radius = list(cablenet.edges_attribute('r'))
# ---------- end python_5 ----------
preview_3 = CustomPreview(Geometry=mesh_4, Material=ColourSwatch(SwatchColor=RGB(204, 204, 204)))
previewlw = CustomPreviewLineweights(Geometry=crv_40, Shader=ColourSwatch(SwatchColor=RGB(168, 168, 168)), Thickness="2", Absolute=False)
num_33 = Number(python_5.forces)
num_34 = Number(python_5.radius)
num_35 = Number(num_33)
bnd = Bounds(Numbers=num_35)
remap_2 = RemapNumbers(Value=num_35, Source=bnd, Target="1.0 to 0.0")  # -> Mapped, Clipped
gradient = Gradient(
    LowerLimit=0,
    UpperLimit=1,
    Parameter=remap_2.Mapped,
    stops=[0: RGB(255, 5, 5), 0.819: RGB(255, 255, 0), 0.949: RGB(0, 200, 255), 1: RGB(0, 34, 255)])
colour = Colour(gradient)
crv_41 = Curve(crv_39)
colour_2 = Colour(colour)
previewlw_2 = CustomPreviewLineweights(Geometry=crv_41, Shader=colour_2, Thickness="3", Absolute=False)
