# Grasshopper definition puerto_rico_module.gh (Grasshopper 1.0.7)
# plug-ins: Human

external_ring_height_m = Slider(4, range=0..10)

backwards_pull_bottom = Slider(-1, range=-10..0)
downwards_pull_bottom = Slider(-0.5, range=-10..0)
num = Number(backwards_pull_bottom)
num_2 = Number(downwards_pull_bottom)

inner_ring_diameter_m = Slider(2.5, range=0..10)
outer_ring_diameter_m = Slider(10, range=0..100)
inner_ring_diameter_m_oval = Slider(3, range=0..10)

lowering_height_tipo_oculus_m = Slider(-1, range=-10..5)
num_3 = Number(lowering_height_tipo_oculus_m)

ring_num_edges = Slider(12, range=0..20)

q_all_members = Slider(1, range=0..10)
module_index = Slider(1, range=0..10)
q_boundary = Slider(0.1, range=0..10)
u_div = Slider(12, range=0..100)
v_div = Slider(6, range=0..10)
int = Integer(module_index)
num_4 = Number(u_div)
num_5 = Number(v_div)
num_6 = Number(q_boundary)
num_7 = Number(q_all_members)

pt = ConstructPoint(XCoordinate=0, YCoordinate=0, ZCoordinate=0)
entwine = Entwine(Branch00=inner_ring_diameter_m, Branch01=outer_ring_diameter_m, FlattenInputs=True)
num_8 = Number(external_ring_height_m)
num_9 = Number(inner_ring_diameter_m_oval)
num_10 = Number(ring_num_edges)
pt_2 = Point(pt)
num_11 = Number(entwine)
num_12 = Number(inner_ring_diameter_m)
python = GhPythonScript(unload=Button())  # -> out, a; inputs unload: Boolean
# ---------- python: Python ----------
from compas_ghpython import unload_modules


modules = ['compas', 'compas_ghpython', 'compas_fofin']
if unload:
    for module in modules:
        unload_modules(module)
# ---------- end python ----------
pt_3 = Point(pt_2)
num_13 = Number(Slider(0, range=0..10))
panel = Panel(python.out)
num_14 = Number(num_11)
pt_4 = Point(pt_2)
num_15 = Number(num_10)
num_16 = Number(num_12)
num_17 = Number(num_10)
num_18 = Number(num_9)
pt_5 = Point(pt_2)
neg = Negative(Value=num_13)
division = Division(A=num_14, B=2)
Y = UnitY(Factor=neg)
division_2 = Division(A=num_16, B=2)
division_3 = Division(A=num_18, B=2)
move = Move(Geometry=pt_3, Motion=Y)  # -> Geometry, Transform
ellipse = Ellipse(Plane=pt_5, Radius1=division_2, Radius2=division_3)  # -> Ellipse, Focus1, Focus2
polygon = Polygon(Plane=pt_4, Radius=division, Segments=num_15, FilletRadius=0)  # -> Polygon, Length
divide = DivideCurve(Curve=ellipse.Ellipse, Count=num_17, Kinks=False)  # -> Points, Tangents, Parameters
crv = Curve(polygon.Polygon)
rectangle = Rectangle(Plane=move.Geometry, XSize="-1.25 to 1.25", YSize="-3.0 to 3.0", Radius=0)  # -> Rectangle, Length
pline = PolyLine(Vertices=divide.Points, Closed=True)
Z = UnitZ(Factor="-2.5")
extr = Extrude(Base=rectangle.Rectangle, Direction=Z)
crv_2 = Curve(pline)
cap = CapHoles(Brep=extr)
brep = Brep(cap)
crv_3 = Curve(crv_2)
crv_4 = Curve(crv)
bang = ExplodeTree(Data=crv_4)  # -> Branch0, Branch1
brep_2 = Brep(brep)  # disabled
swatch = ColourSwatch(SwatchColor=RGB(255, 255, 255))  # disabled
preview = CustomPreview(Geometry=brep_2, Material=swatch)  # disabled
entwine_2 = Entwine(Branch00=crv_3, Branch01=bang.Branch1, FlattenInputs=True)
crv_5 = Curve(entwine_2)
num_19 = Number(num_8)
crv_6 = Curve(crv)
explode = Explode(Curve=crv_6, Recursive=True)  # -> Segments, Vertices
entwine_3 = Entwine(Branch00="0.0", Branch01=num_19, FlattenInputs=True)
cullpt = CullDuplicates(Points=explode.Vertices, Tolerance=0.1, CullMode=3)  # -> Points, Indices, Valence
Z_2 = UnitZ(Factor=entwine_3)
move_2 = Move(Geometry=cullpt.Points, Motion=Z_2)  # -> Geometry, Transform
pline_2 = PolyLine(Vertices=move_2.Geometry, Closed="TRue")
crv_7 = Curve(pline_2)
crv_8 = Curve(crv_7)
explode_2 = Explode(Curve=crv_8, Recursive=True)  # -> Segments, Vertices
cullpt_2 = CullDuplicates(Points=explode_2.Vertices, Tolerance=0.1, CullMode=1)  # -> Points, Indices, Valence
flip = FlipMatrix(Data=cullpt_2.Points)
pline_3 = PolyLine(Vertices=flip, Closed=False)
num_20 = Number("0.25")
crv_9 = Curve(pline_3)
pt_6 = Point(cullpt_2.Points)
crv_10 = Curve(explode_2.Segments)
subtraction = Subtraction(A=num_20, B=1)
abs = Absolute(Value=subtraction)
crv_11 = Curve(crv_9)
crv_12 = Curve(crv_9)
num_21 = Number("0.25")
avr = Average(Input=[num_20, abs])
flip_2 = FlipCurve(Curve=crv_12)  # -> Curve, Flag
end = EndPoints(Curve=crv_11)  # -> Start, End
eval = EvaluateCurve(Curve=reparameterize(flip_2.Curve), Parameter=num_21)  # -> Point, Tangent, Angle
entwine_4 = Entwine(Branch00=num_20, Branch01=avr, Branch02=abs, FlattenInputs=True)  # -> flatten(Result)
num_22 = Number(entwine_4)
pt_7 = Point(eval.Point)
pt_8 = Point(end.End)
crv_13 = Curve(crv_10)
num_23 = Number(num_22)
graft = GraftTree(Tree=crv_13, IncludeEmptyLists=True, IncludeNullItems=True)
eval_2 = EvaluateCurve(Curve=reparameterize(graft), Parameter=num_23)  # -> Point, Tangent, Angle
pt_9 = Point(simplify(eval_2.Point))
pt_10 = Point(simplify(pt_9))
pt_11 = Point(pt_6)
pt_12 = Point(simplify(pt_7))
pt_13 = Point(simplify(pt_8))
split = SplitTree(Data=pt_10, Masks=flatten("{0;*}"))  # -> Positive, Negative
split_2 = SplitTree(Data=simplify(pt_11), Masks=flatten("{0;*}"))  # -> Positive, Negative
flatten = FlattenTree(Tree=split_2.Positive, Path="{0}")
flatten_2 = FlattenTree(Tree=pt_12, Path="{0}")
flatten_3 = FlattenTree(Tree=pt_13, Path="{0}")
python_2 = GhPythonScript(points=split.Positive, corners=flatten)  # -> out, a, b, tree; inputs points: tree, corners: list
# ---------- python_2: Python ----------
import rhinoscriptsyntax as rs
import clr
clr.AddReference("Grasshopper")
import Grasshopper.Kernel.Data.GH_Path as ghpath
import Grasshopper.DataTree as datatree
import System
 
from compas.utilities import pairwise




tree = datatree[System.Object]()
paths = points.Paths

j = int(len(paths)) - 1
paths =  [paths[j]] + list(paths)

for idx, corner in enumerate(corners):
    
    part_a = list(points.Branch(paths[idx+1]))
    part_b = list(points.Branch(paths[idx]))
    
    print(part_a)
    print(part_b)
    print(corner)
    mylist = part_b[-2:] + [corner] + part_a[:2]


    tree.AddRange(mylist, ghpath(idx))
# ---------- end python_2 ----------
python_3 = GhPythonScript(points=split.Negative, corners=flatten_3)  # -> out, a, b, tree; inputs points: tree, corners: list
# ---------- python_3: Python ----------
import rhinoscriptsyntax as rs
import clr
clr.AddReference("Grasshopper")
import Grasshopper.Kernel.Data.GH_Path as ghpath
import Grasshopper.DataTree as datatree
import System
 
from compas.utilities import pairwise




tree = datatree[System.Object]()
paths = points.Paths

j = int(len(paths)) - 1
paths =  [paths[j]] + list(paths)

for idx, corner in enumerate(corners):
    
    part_a = list(points.Branch(paths[idx+1]))
    part_b = list(points.Branch(paths[idx]))
    
    print(part_a)
    print(part_b)
    print(corner)
    mylist = part_b[-1:] + [corner] + part_a[:1]


    tree.AddRange(mylist, ghpath(idx))
# ---------- end python_3 ----------
python_4 = GhPythonScript(points=split.Negative, corners=flatten_2)  # -> out, a, b, tree; inputs points: tree, corners: list; same code as python_2
pt_14 = Point(python_4.tree)
pt_15 = Point(python_2.tree)
pt_16 = Point(python_3.tree)
pt_17 = Point(pt_15)
pt_18 = Point(pt_16)
pt_19 = Point(pt_14)
tstat = TreeStatistics(Tree=pt_17)  # -> Paths, Length, Count
int_2 = Integer(int)
item = ListItem(List=tstat.Paths, Index=int_2, Wrap=True)
branch = TreeBranch(Tree=pt_17, Path=item, MaintainPaths=True)
branch_2 = TreeBranch(Tree=pt_18, Path=item, MaintainPaths=True)
branch_3 = TreeBranch(Tree=pt_19, Path=item, MaintainPaths=True)
num_24 = Number(num_2)
num_25 = Number(num)
pt_20 = Point(branch)
pt_21 = Point(graft(pt_20))
pt_22 = Point(branch_2)
pt_23 = Point(branch_3)
entwine_5 = Entwine(Branch00="0.0", Branch01="0.0", Branch02=num_24, Branch03="0.0", Branch04="0.0", FlattenInputs=True)
entwine_6 = Entwine(Branch00="0.0", Branch01="0.0", Branch02=num_25, Branch03="0.0", Branch04="0.0", FlattenInputs=True)
pt_24 = ConstructPoint(XCoordinate=0, YCoordinate=0, ZCoordinate=0)
Z_3 = UnitZ(Factor=entwine_5)
pt_25 = Point(pt_22)
num_26 = Number(num_3)
pt_26 = Point(pt_23)
num_27 = Number(num_4)
num_28 = Number(num_5)
vec2pt = Vector2Pt(PointA=pt_21, PointB=pt_24, Unitize=True)  # -> Vector, Length
move_3 = Move(Geometry=pt_21, Motion=Z_3)  # -> Geometry, Transform
multiplication = Multiplication(A=vec2pt.Vector, B=entwine_6)
pt_27 = Point(pt_23)
move_4 = Move(Geometry=move_3.Geometry, Motion=multiplication)  # -> flatten(Geometry), Transform
item_2 = ListItem(List=pt_27, Index=0, Wrap=True)  # -> Item1, Item, Item1_2
pt_28 = Point(flatten(move_4.Geometry))
pt_29 = Point(pt_28)
pt_30 = Point(pt_28)
entwine_7 = Entwine(Branch00=pt_26, Branch01=pt_29, FlattenInputs=True)
item_3 = ListItem(List=pt_30, Index=0, Wrap=True)  # -> Item1, Item, Item1_2, Item2
graft_2 = GraftTree(Tree=pt_25, IncludeEmptyLists=True, IncludeNullItems=True)
entwine_8 = Entwine(Branch00="0", Branch01=num_26, Branch02="0", FlattenInputs=True)
pline_4 = PolyLine(Vertices=entwine_7, Closed=False)
pt_31 = Point([item_3.Item1, item_3.Item, item_3.Item2])
explode_3 = Explode(Curve=pline_4, Recursive=True)  # -> Segments, Vertices
Z_4 = UnitZ(Factor=entwine_8)
graft_3 = GraftTree(Tree=pt_31, IncludeEmptyLists=True, IncludeNullItems=True)
move_5 = Move(Geometry=graft_2, Motion=Z_4)  # -> Geometry, Transform
divide_2 = DivideCurve(Curve=explode_3.Segments, Count=num_28, Kinks=False)  # -> simplify(Points), Tangents, Parameters
graft_4 = GraftTree(Tree=divide_2.Points, IncludeEmptyLists=True, IncludeNullItems=True)
flatten_4 = FlattenTree(Tree=move_5.Geometry, Path="{0}")
path_mapper = PathMapper(graft_4, source="{A;B;C}", target="{B;C}")
pline_5 = PolyLine(Vertices=path_mapper, Closed=False)
path_mapper_2 = PathMapper(pline_5, source="{A;B}", target="{path_index}")
divide_3 = DivideCurve(Curve=path_mapper_2, Count=num_27, Kinks=False)  # -> simplify(Points), Tangents, Parameters
pt_32 = Point(flatten_4)
pt_33 = Point(pt_32)
item_4 = ListItem(List=pt_33, Index=0, Wrap=True)  # -> Item, Item1
pt_34 = Point(item_4.Item1)
entwine_9 = Entwine(Branch00=pt_34, Branch01=[item_2.Item1, item_2.Item], Branch02=graft_3, FlattenInputs=True)
flatten_5 = FlattenTree(Tree=entwine_9, Path="{0}")
pt_35 = Point(flatten_5)
flip_3 = FlipMatrix(Data=divide_3.Points)
pline_6 = PolyLine(Vertices=flatten_4, Closed=False)
pline_7 = PolyLine(Vertices=divide_3.Points, Closed=False)
pline_8 = PolyLine(Vertices=flip_3, Closed=False)
explode_4 = Explode(Curve=pline_7, Recursive=True)  # -> Segments, Vertices
explode_5 = Explode(Curve=pline_6, Recursive=True)  # -> Segments, Vertices
explode_6 = Explode(Curve=pline_8, Recursive=True)  # -> Segments, Vertices
line = Line(explode_6.Segments)
line_2 = Line(explode_5.Segments)
line_3 = Line(explode_4.Segments)
panel_2 = Panel("""oculus
u_dir
v_dir""")
crv_14 = Curve(line_3)
crv_15 = Curve(line_2)
crv_16 = Curve(line)
entwine_10 = Entwine(Branch00=crv_15, Branch01=crv_14, Branch02=crv_16, FlattenInputs=True)
graft_5 = GraftTree(Tree=panel_2, IncludeEmptyLists=True, IncludeNullItems=True)
lng = ListLength(List=entwine_10)
flatten_6 = FlattenTree(Tree=entwine_10, Path="{0}")
dup = DuplicateData(Data=graft_5, Number=lng, Order=True)
crv_17 = Curve(flatten_6)
flatten_7 = FlattenTree(Tree=dup, Path="{0}")
txt = Text(flatten_7)
python_5 = GhPythonScript(run_proxy=Toggle(False), stop_server=Toggle(False))  # -> out, a; inputs run_proxy: Boolean, stop_server: Boolean
# ---------- python_5: Python ----------
from compas.rpc import Proxy
import scriptcontext as sc

import compas_fofin.fofin

if run_proxy:
    proxy = Proxy('compas_fofin.fofin')
    sc.sticky['fofin'] = proxy
    
    if stop_server:
        proxy.stop_server()
# ---------- end python_5 ----------
crv_18 = Curve(crv_17)
pt_36 = Point(pt_35)
num_29 = Number(num_6)
num_30 = Number(num_7)
txt_2 = Text(txt)
panel_3 = Panel(python_5.out)
flatten_8 = FlattenTree(Tree=pt_36, Path="{0}")
end_2 = EndPoints(Curve=crv_18)  # -> Start, End
python_6 = GhPythonScript(x=end_2.Start, y=end_2.End)  # -> out, a; inputs x: list of Point3d, y: list of Point3d
# ---------- python_6: Python ----------
__author__ = "arpj"

import rhinoscriptsyntax as rs

a = []

for start, end in zip(x, y):
    start = [start.X, start.Y, start.Z]
    end = [end.X, end.Y, end.Z]
    a.append((start, end))
# ---------- end python_6 ----------
python_7 = GhPythonScript(x=flatten_8)  # -> out, a; inputs x: list of Point3d
# ---------- python_7: Python ----------
__author__ = "arpj"

import rhinoscriptsyntax as rs

a = []

for start in x:
    point = [start.X, start.Y, start.Z]
    a.append(point)
# ---------- end python_7 ----------
python_8 = GhPythonScript(lines=python_6.a, anchors=python_7.a, q_boundary=num_29, q_boundary_2=num_30)  # -> out, vertices, edges, faces, reactions, stresses, forces, cablenet; inputs lines: list, anchors: list
# ---------- python_8: Python ----------
#!/usr/bin/env python
# -*- coding: utf-8 -*-

import os
import math
import compas
import Rhino
import rhinoscriptsyntax as rs

from compas.datastructures import Mesh
from compas.utilities import Colormap
from compas.utilities import geometric_key

from compas_fofin.datastructures import Cablenet
from compas_fofin.analysis import mesh_materialize_cables

from compas_fofin.fofin import update_xyz_proxy
from compas.rpc import Proxy
import compas_fofin.fofin

from compas_rhino.utilities import get_line_coordinates
from compas_rhino.utilities import get_point_coordinates

from compas_rhino.selectors import EdgeSelector
from compas_rhino.selectors import VertexSelector

from compas_fofin.rhino import CablenetArtist

from compas.geometry import angle_vectors
from compas.geometry import dot_vectors
from compas.geometry import distance_point_point

from compas_ghpython.artists import MeshArtist

import scriptcontext as sc

def edges_where_midpoints_in_rh_lines(struct, lines):
	lines = {geometric_key(rs.CurveMidPoint(line)): line for line in lines}
	edges = {geometric_key(struct.edge_midpoint(u, v)): (u, v) for u, v in struct.edges()}
	for gkey, ekey in edges.items():
		if lines.get(gkey) is not None:
			yield ekey

# ==============================================================================
# Call Proxy Locally
# ==============================================================================

fofin = sc.sticky['fofin']

# ==============================================================================
# Files IO
# ==============================================================================

# HERE = os.path.dirname(__file__)
# FILE_I = os.path.join(HERE, 'lines.json')
# FILE_O = os.path.join(HERE, 'hypar.json')

# ==============================================================================
# Create a cablenet from Rhino
# ==============================================================================

# lines = list(zip(get_point_coordinates(start), get_point_coordinates(end)))
# cablenet = Cablenet.from_lines(get_line_coordinates(lines), True)
cablenet = Cablenet.from_lines(lines, True)

# ==============================================================================
# Create a cablenet from Rhino
# ==============================================================================

max_num_vertices = 4
deletable = set()
for fkey in cablenet.faces():
    if distance_point_point(cablenet.face_centroid(fkey), [0, 0, 0]) > 0.10:
    # if len(cablenet.face_vertices(fkey)) <= max_num_vertices:
        continue
    
    deletable.add(fkey)

print('deletable ', len(deletable))
for fkey in deletable:
    cablenet.delete_face(fkey)
    
# ==============================================================================
# Set material density for self-weight
# ==============================================================================

cablenet.attributes['density'] = 0.

# ==============================================================================
# Set and move anchors
# ==============================================================================

gkey_key = cablenet.gkey_key()
for xyz in anchors:
	vkey = gkey_key[geometric_key(xyz)]
	cablenet.vertex_attributes(vkey, ['is_anchor', 'is_fixed'], [True, True])
    
# ==============================================================================
# Change Force Densities
# ==============================================================================

# z_coords = list(cablenet.vertices_attribute('z'))
z_coords = [cablenet.edge_midpoint(u, v)[2] for u, v in cablenet.edges()]
z_max = max(z_coords)
z_min = min(z_coords)

for edge in cablenet.edges():
    cablenet.edge_attributes(edge, ['q'], [q_boundary])
    
for edge in cablenet.edges_on_boundary():      
    # if math.fabs(cablenet.edge_midpoint(*edge)[2] - z_min) <= 0.01:
    cablenet.edge_attributes(edge, ['q'], [q_boundary_2])
      
# count = 0
# for edge in cablenet.edges():
# 	edge_vec = cablenet.edge_vector(*edge)
	# if angle_vectors([1.0, 0.0, 0.0], edge_vec, deg=True) > 90:
	# if dot_vectors([1.0, 0.0, 0.0], edge_vec) <= 0.0:
	# 	cablenet.edge_attributes(edge, ['q'], [2.0])
	# 	count += 1

# count = 0
# for edge in edges_where_midpoints_in_rh_lines(cablenet, rh_edges_3):
# 	cablenet.edge_attributes(edge, ['q'], [4.0])
#  	count += 1

# for edge in edges_where_midpoints_in_rh_lines(cablenet, rh_edges_1):
# 	cablenet.edge_attributes(edge, ['q'], [1.0])

# for edge in edges_where_midpoints_in_rh_lines(cablenet, rh_edges_4):
# 	cablenet.edge_attributes(edge, ['q'], [1.0])

# ==============================================================================
# Apply point loads
# ==============================================================================

# for xyz in get_point_coordinates(rh_point_loads):
# 	vkey = gkey_key[geometric_key(xyz)]
# 	cablenet.vertex_attributes(vkey, ['py'], [0.6])

# ==============================================================================
# Compute equilibrium with Proxy
# ==============================================================================

data = fofin.update_xyz_proxy(cablenet.to_data())
cablenet = Cablenet.from_data(data)

# ==============================================================================
# Assign radius to cables
# ==============================================================================

mesh_materialize_cables(cablenet)

# ==============================================================================
# Change scriptcontext doc
# ==============================================================================

sc.doc = Rhino.RhinoDoc.ActiveDoc

# ==============================================================================
# Visualize
# ==============================================================================

# heights = cablenet.vertices_attribute('z')
# cmap = Colormap(heights, 'black')
# vertexcolor = {key: cmap(z) for key, z in zip(cablenet.vertices(), heights)}

# forces = cablenet.edges_attribute('f')
# cmap = Colormap(forces, 'rgb')
# edgecolor = {key: cmap(f) for key, f in zip(cablenet.edges(), forces)}


# artist = MeshArtist(cablenet)
artist = CablenetArtist(cablenet, layer='cablenet')
artist.clear_layer()

vertices = artist.draw_vertices()
edges = artist.draw_edges()
faces = artist.draw_faces()

# reactions = artist.draw_reactions()
# forces = artist.draw_forces(scale=0.05)
# stresses = artist.draw_stress(0.025)

artist.redraw()

# ==============================================================================
# Restore scriptcontext doc
# ==============================================================================

sc.doc = ghdoc

# ==============================================================================
# Export
# ==============================================================================

# cablenet.to_json(FILE_O)
# ---------- end python_8 ----------
panel_4 = Panel(python_6.out)
crv_19 = Curve(python_8.edges)
mesh = Mesh(python_8.faces)
geo = Geometry(python_8.stresses)
geo_2 = Geometry(python_8.reactions)
geo_3 = Geometry(python_8.forces)
data = Data(python_8.cablenet)
panel_5 = Panel(python_8.out)
mesh_2 = Mesh(mesh)
crv_20 = Curve(crv_19)
data_2 = Data(data)
python_9 = GhPythonScript(cablenet=data_2)  # -> out, q, forces, radius
# ---------- python_9: Python ----------
forces = list(cablenet.edges_attribute('f'))
radius = list(cablenet.edges_attribute('r'))
q = list(cablenet.edges_attribute('q'))
# ---------- end python_9 ----------
preview_2 = CustomPreview(Geometry=mesh_2, Material=ColourSwatch(SwatchColor=RGB(204, 204, 204)))  # disabled
previewlw = CustomPreviewLineweights(Geometry=crv_20, Shader=ColourSwatch(SwatchColor=RGB(168, 168, 168)), Thickness="2", Absolute=False)
num_31 = Number(python_9.q)
num_32 = Number(python_9.forces)
num_33 = Number(python_9.radius)
num_34 = Number(num_31)
bnd = Bounds(Numbers=num_34)
remap = RemapNumbers(Value=num_34, Source=bnd, Target="1.0 to 0.0")  # -> Mapped, Clipped
dedomain = DeconstructDomain(Domain=bnd)  # -> Start, End
gradient = Gradient(
    LowerLimit=0,
    UpperLimit=1,
    Parameter=remap.Mapped,
    stops=[0: RGB(255, 5, 5), 0.819: RGB(255, 255, 0), 0.949: RGB(0, 200, 255), 1: RGB(0, 34, 255)])
range = Range(Domain=bnd, Steps=10)
gradient_2 = Gradient(
    LowerLimit=dedomain.Start,
    UpperLimit=dedomain.End,
    Parameter=range,
    stops=[0: RGB(255, 5, 5), 0.365: RGB(255, 255, 0), 0.66: RGB(0, 200, 255), 1: RGB(0, 34, 255)])
eval_3 = Evaluate(F="round(x, 4)", x=range)
rectangle_2 = Rectangle(Plane=PlaneXY(0, 0, 0), XSize=Domain(-1, 1), YSize=Domain(-2, 2), Radius=0)  # -> Rectangle, Length
colour = Colour(gradient)
concat = Concatenate(FragmentA=eval_3, FragmentB=" kN")
legend = Legend(Colour=gradient_2, Tags=concat, Rectangle=rectangle_2.Rectangle, LegendType=1)
subtraction_2 = Subtraction(A=Slider(7, range=0..10), B=1)
pt_37 = ConstructPoint(XCoordinate=0, YCoordinate=0, ZCoordinate=0)
crv_21 = Curve(crv_19)
range_2 = Range(Domain=Domain(0, 1), Steps=subtraction_2)
crv_22 = Curve(crv_19)
colour_2 = Colour(colour)
group = Group(Objects=crv_21)
Z_5 = UnitZ(Factor=1)
remap_2 = RemapNumbers(Value=range_2, Source=Domain(0, 1), Target="0 to 360")  # -> Mapped, Clipped
previewlw_2 = CustomPreviewLineweights(Geometry=crv_22, Shader=colour_2, Thickness="3", Absolute=False)
line_4 = LineSDL(Start=pt_37, Direction=Z_5, Length=1)
rotax = RotateAxis(Geometry=group, Angle=degrees(remap_2.Mapped), Axis=line_4)  # -> Geometry, Transform
createatts = CreateAttributes(Color=colour_2, enableFullPath=False)
ungroup = Ungroup(Group=rotax.Geometry)
bake = BakeGeometry(Bake=Button(), Geometry=crv_22, Attributes=createatts, DeleteOldBakes=False, PreserveTrees=False)
crv_23 = Curve(ungroup)
crv_24 = Curve(crv_23)
Z_6 = UnitZ(Factor="0.25")
rotax_2 = RotateAxis(Geometry=crv_24, Angle=1.570796327, Axis=line_4)  # -> Geometry, Transform
move_6 = Move(Geometry=rotax_2.Geometry, Motion=Z_6)  # -> Geometry, Transform
crv_25 = Curve(move_6.Geometry)
crv_26 = Curve(crv_23)
colour_3 = Colour(colour)
crv_27 = Curve(crv_25)
previewlw_3 = CustomPreviewLineweights(Geometry=crv_26, Shader=colour_3, Thickness="3", Absolute=False)  # disabled
previewlw_4 = CustomPreviewLineweights(Geometry=crv_27, Shader=colour_3, Thickness="3", Absolute=False)  # disabled
