# Grasshopper definition puerto_rico_oracle.gh (Grasshopper 1.0.7)
# plug-ins: Human, Weaverbird, Kangaroo2 Components

panel = Panel("""spine_left
spine_right""")
fix_boundary_long = BooleanToggle(True)
num_u = Slider(14, range=0..100)
q_all = Slider(6, range=1..10)
q_trans = Slider(0.2, range=0.1..1.1)
q_oculus = Slider(3, range=0..10)
q_boundary_long = Slider(0, range=0..300)
q_boundary_trans = Slider(30, range=0..30)
support_height_z = Slider(1, range=0..2)
hole_start_index = Slider(15, range=0..30)
hole_width = Slider(1, range=0..10)
hole_steps = Slider(12, range=0..20)
txt = Text(panel)
txt_2 = Text("anchors")
panel_2 = Panel("6")
panel_3 = Panel("0.2")
panel_4 = Panel("3.0")
txt_3 = Text(txt)
txt_4 = Text(txt_2)
panel_5 = Panel("30")
dpipeline = DynamicGeometryPipeline(
    LayerFilter=txt_3,
    TypeFilter="curve",
    NameFilter="*",
    GroupByLayer=False,
    GroupByType=False,
    IncludeHidden=True,
    IncludeLocked=True,
    enableFullPath=False,
    listenToAttributes=True)
dpipeline_2 = DynamicGeometryPipeline(
    LayerFilter=txt_4,
    TypeFilter="Point",
    NameFilter="*",
    GroupByLayer=False,
    GroupByType=False,
    IncludeHidden=True,
    IncludeLocked=True,
    enableFullPath=False,
    listenToAttributes=True)
division = Division(A=num_u, B=2)
multiplication = Multiplication(A=hole_width, B="2")
addition = Addition(A=hole_width, B=1)
multiplication_2 = Multiplication(A=num_u, B="10")
subtraction = Subtraction(A=division, B=hole_width)
addition_2 = Addition(A=multiplication, B=1)
multiplication_3 = Multiplication(A=addition, B=2)
subtraction_2 = Subtraction(A=division, B=addition)
neg = Negative(Value=support_height_z)
series = Series(Start=subtraction, Step=1, Count=addition_2)
bool = Boolean(fix_boundary_long)
crv = Curve(dpipeline)
pt = Point(dpipeline_2)
int = Integer(num_u)
int_2 = Integer(multiplication_2)
num = Number(q_all)
num_2 = Number(q_trans)
num_3 = Number(q_oculus)
num_4 = Number(q_all)
num_5 = Number(q_boundary_trans)
int_3 = Integer(hole_start_index)
int_4 = Integer(hole_steps)
int_5 = Integer(subtraction_2)
int_6 = Integer(multiplication_3)
int_7 = Integer(series)
num_6 = Number(neg)
int_8 = Integer(division)
crv_2 = Curve(crv)
int_9 = Integer(int)
int_10 = Integer(int_2)
cp = ControlPoints(Curve=crv_2)  # -> Points, Weights, Knots
flip = FlipMatrix(Data=cp.Points)
pline = PolyLine(Vertices=flip, Closed=False)
explode = Explode(Curve=pline, Recursive=True)  # -> Segments, Vertices
divide = DivideCurve(Curve=explode.Segments, Count=int_9, Kinks=False)  # -> simplify(Points), Tangents, Parameters
flip_2 = FlipMatrix(Data=divide.Points)
pline_2 = PolyLine(Vertices=flip_2, Closed=False)
divide_2 = DivideCurve(Curve=pline_2, Count=int_10, Kinks=False)  # -> simplify(Points), Tangents, Parameters
flip_3 = FlipMatrix(Data=divide_2.Points)
pline_3 = PolyLine(Vertices=divide_2.Points, Closed=False)
pline_4 = PolyLine(Vertices=flip_3, Closed=False)
explode_2 = Explode(Curve=pline_3, Recursive=True)  # -> Segments, Vertices
explode_3 = Explode(Curve=pline_4, Recursive=True)  # -> Segments, Vertices
crv_3 = Curve(explode_2.Segments)
crv_4 = Curve(explode_3.Segments)
crv_5 = Curve(crv_4)
int_11 = Integer(int_5)
int_12 = Integer(int_6)
int_13 = Integer(int_4)
int_14 = Integer(int_3)
crv_6 = Curve(crv_3)
int_15 = Integer(int_3)
int_16 = Integer(int_7)
int_17 = Integer(int_4)
subtraction_3 = Subtraction(A=int_13, B=1)
addition_3 = Addition(A=int_14, B=1)
series_2 = Series(Start=int_11, Step=1, Count=int_12)
path = DataPath(int_16)
tstat = TreeStatistics(Tree=crv_5)  # -> Paths, Length, Count
series_3 = Series(Start=int_15, Step=1, Count=int_17)
series_4 = Series(Start=addition_3, Step=1, Count=subtraction_3)
subtraction_4 = Subtraction(A=tstat.Count, B=1)
split = SplitTree(Data=simplify(crv_6), Masks=flatten(path))  # -> Positive, Negative
subtraction_5 = Subtraction(A=subtraction_4, B=series_4)
tstat_2 = TreeStatistics(Tree=split.Positive)  # -> Paths, Length, Count
merge = Merge(Data1=series_4, Data2=subtraction_5)
lng = ListLength(List=path)
graft = GraftTree(Tree=tstat_2.Length, IncludeEmptyLists=True, IncludeNullItems=True)
path_2 = DataPath(merge)
dup = DuplicateData(Data=graft(series_3), Number=lng, Order=True)
subtraction_6 = Subtraction(A=graft, B=series_3)
split_2 = SplitTree(Data=simplify(crv_5), Masks=flatten(path_2))  # -> Positive, Negative
flip_4 = FlipMatrix(Data=dup)
subtraction_7 = Subtraction(A=subtraction_6, B=1)
match = MatchTree(Tree=flip_4, Guide=subtraction_6)
cull_i = CullIndex(List=split_2.Positive, Indices=series_2, Wrap=True)
match_2 = MatchTree(Tree=cull_i, Guide=split_2.Positive)
merge_2 = Merge(Data1=match, Data2=subtraction_7)
cull_i_2 = CullIndex(List=split.Positive, Indices=merge_2, Wrap=True)
merge_3 = Merge(Data1=split_2.Negative, Data2=match_2)
match_3 = MatchTree(Tree=cull_i_2, Guide=split.Positive)
merge_4 = Merge(Data1=split.Negative, Data2=match_3)
crv_7 = Curve(merge_4)
crv_8 = Curve(merge_3)
int_18 = Integer(int_8)
crv_9 = Curve(crv_7)
panel_6 = Panel("""long
trans""")
crv_10 = Curve(crv_7)
crv_11 = Curve(crv_8)
path_3 = DataPath(int_18)
entwine = Entwine(Branch00=crv_10, Branch01=crv_11, FlattenInputs=True)
branch = TreeBranch(Tree=crv_9, Path=path_3, MaintainPaths=True)
graft_2 = GraftTree(Tree=panel_6, IncludeEmptyLists=True, IncludeNullItems=True)
lng_2 = ListLength(List=entwine)
flatten = FlattenTree(Tree=entwine, Path="{0}")
join = JoinCurves(Curves=branch, Preserve=False)
dup_2 = DuplicateData(Data=graft_2, Number=lng_2, Order=True)  # -> flatten(Data)
item = ListItem(List=join, Index=0, Wrap=True)  # -> Item, Item1
end = EndPoints(Curve=item.Item1)  # -> Start, End
merge_5 = Merge(Data1=end.Start, Data2=end.End)
crv_12 = Curve(flatten)
txt_5 = Text(dup_2)
pt_2 = Point(merge_5)
crv_13 = Curve(crv_12)
pt_3 = Point(pt_2)
txt_6 = Text(txt_5)
num_7 = Number(num_6)
num_8 = Number(num_2)
num_9 = Number(num_4)
pt_4 = Point(pt)
num_10 = Number(num)
num_11 = Number(num_3)
num_12 = Number(num_5)
bool_2 = Boolean(bool)
end_2 = EndPoints(Curve=crv_13)  # -> Start, End
neg_2 = Negative(Value=num_7)
flatten_2 = FlattenTree(Tree=pt_3, Path="{0}")
flatten_3 = FlattenTree(Tree=pt_4, Path="{0}")
python = GhPythonScript(x=flatten_3)  # -> out, a; inputs x: list of Point3d
# ---------- python: Python ----------
__author__ = "arpj"

import rhinoscriptsyntax as rs

a = []

for start in x:
    point = [start.X, start.Y, start.Z]
    a.append(point)
# ---------- end python ----------
python_2 = GhPythonScript(x=flatten_2)  # -> out, a; inputs x: list of Point3d; same code as python
python_3 = GhPythonScript(x=end_2.Start, y=end_2.End)  # -> out, a; inputs x: list of Point3d, y: list of Point3d
# ---------- python_3: Python ----------
__author__ = "arpj"

import rhinoscriptsyntax as rs

a = []

for start, end in zip(x, y):
    start = [start.X, start.Y, start.Z]
    end = [end.X, end.Y, end.Z]
    a.append((start, end))
# ---------- end python_3 ----------
python_4 = GhPythonScript(run_proxy=Toggle(True), stop_server=Toggle(False))  # -> out, a; inputs run_proxy: Boolean, stop_server: Boolean
# ---------- python_4: Python ----------
from compas.rpc import Proxy
import scriptcontext as sc

import compas_fofin.fofin

if run_proxy:
    proxy = Proxy('compas_fofin.fofin')
    sc.sticky['fofin'] = proxy
    
    if stop_server:
        proxy.stop_server()
# ---------- end python_4 ----------
python_5 = GhPythonScript(
    lines=python_3.a,
    anchors=python_2.a,
    anchors_corners=python.a,
    tags=txt_6,
    fix_boundary_long=bool_2,
    z_support=neg_2,
    q_all=num_10,
    q_trans=num_8,
    q_oculus=num_11,
    q_boundary_long=num_9,
    q_boundary_trans=num_12)  # -> out, vertices, edges, faces, mesh, reactions, stresses, forces, cablenet, edge_keys; inputs lines: list, anchors: list, anchors_corners: list, tags: list, fix_boundary_long: Boolean
# ---------- python_5: Python ----------
#!/usr/bin/env python
# -*- coding: utf-8 -*-

import os
import math
import compas
import Rhino
import rhinoscriptsyntax as rs

from compas.datastructures import Mesh
from compas.utilities import Colormap
from compas.utilities import geometric_key

from compas_fofin.datastructures import Cablenet
from compas_fofin.analysis import mesh_materialize_cables

from compas_fofin.fofin import update_xyz_proxy
from compas.rpc import Proxy
import compas_fofin.fofin

from compas_rhino.utilities import get_line_coordinates
from compas_rhino.utilities import get_point_coordinates

from compas_rhino.selectors import EdgeSelector
from compas_rhino.selectors import VertexSelector

from compas_fofin.rhino import CablenetArtist

from compas.geometry import angle_vectors
from compas.geometry import dot_vectors
from compas.geometry import distance_point_point
from compas.geometry import centroid_points

from compas_ghpython.artists import MeshArtist

import scriptcontext as sc


def edges_where_midpoints_in_rh_lines(struct, lines):
	lines = {geometric_key(rs.CurveMidPoint(line)): line for line in lines}
	edges = {geometric_key(struct.edge_midpoint(u, v)): (u, v) for u, v in struct.edges()}
	for gkey, ekey in edges.items():
		if lines.get(gkey) is not None:
			yield ekey

# ==============================================================================
# Call Proxy Locally
# ==============================================================================

fofin = sc.sticky['fofin']

# ==============================================================================
# Create a cablenet from Rhino
# ==============================================================================

cablenet = Cablenet.from_lines(lines, True)

# ==============================================================================
# Set material density for self-weight
# ==============================================================================

cablenet.attributes['density'] = 0.

# ==============================================================================
# Preset tags
# ==============================================================================

midpoint_uv = {geometric_key(cablenet.edge_midpoint(*edge)): edge for edge in cablenet.edges()}
edges_found = []
for line in lines:
    edge = midpoint_uv[geometric_key(centroid_points(line))]
    edges_found.append(edge)

# ==============================================================================
# Set tags
# ==============================================================================

for edge, tag in zip(edges_found, tags):
    cablenet.edge_attributes(edge, ['tag'], [tag])

# ==============================================================================
# Set and move anchors
# ==============================================================================

gkey_key = cablenet.gkey_key()
for xyz in anchors:
    try:
        vkey = gkey_key[geometric_key(xyz)]
        cablenet.vertex_attributes(vkey, ['is_anchor', 'is_fixed'], [True, True])
        z = cablenet.vertex_attribute(vkey, 'z')
        cablenet.vertex_attribute(vkey, 'z', z-z_support)
        
    except KeyError:
        print(geometric_key(xyz), ' not found!')

for xyz in anchors_corners:
    try:
        vkey = gkey_key[geometric_key(xyz)]
        cablenet.vertex_attributes(vkey, ['is_anchor', 'is_fixed'], [True, True])
    except KeyError:
        print(geometric_key(xyz), ' not found!')

#for vkey in cablenet.vertices_on_boundary():
#    cablenet.vertex_attributes(vkey, ['is_anchor', 'is_fixed'], [True, True])


    
# ==============================================================================
# Change Force Densities
# ==============================================================================
for edge in cablenet.edges():
    cablenet.edge_attributes(edge, ['q'], [q_all])

for edge in cablenet.edges():
    tag = cablenet.edge_attribute(edge, 'tag')
    if tag == 'trans':
        cablenet.edge_attributes(edge, ['q'], [q_trans])

for edge in cablenet.edges_on_boundary():
    tag = cablenet.edge_attribute(edge, 'tag')
    if tag == 'trans':
        cablenet.edge_attributes(edge, ['q'], [q_boundary_trans])
    elif tag == 'long':
        cablenet.edge_attributes(edge, ['q'], [q_boundary_long])
        if not fix_boundary_long:
            continue
        for vkey in edge:
            cablenet.vertex_attributes(vkey, ['is_anchor', 'is_fixed'], [True, True])

# ==============================================================================
# Change Force Density Oculus
# ==============================================================================

max_num_vertices = 4
for fkey in cablenet.faces():
    if len(cablenet.face_vertices(fkey)) > max_num_vertices:
        for edge in cablenet.face_halfedges(fkey):
            cablenet.edge_attributes(edge, ['q'], [q_oculus])

# ==============================================================================
# Apply point loads
# ==============================================================================

# for xyz in get_point_coordinates(rh_point_loads):
# 	vkey = gkey_key[geometric_key(xyz)]
# 	cablenet.vertex_attributes(vkey, ['py'], [0.6])

# ==============================================================================
# Compute equilibrium with Proxy
# ==============================================================================

data = fofin.update_xyz_proxy(cablenet.to_data())
cablenet = Cablenet.from_data(data)

# ==============================================================================
# Set tags
# ==============================================================================
for edge, tag in zip(edges_found, tags):
    cablenet.edge_attributes(edge, ['tag'], [tag])
  
edge_keys = [edge for edge in cablenet.edges()]
# ==============================================================================
# Assign radius to cables
# ==============================================================================

mesh_materialize_cables(cablenet)

# ==============================================================================
# Change scriptcontext doc
# ==============================================================================

sc.doc = Rhino.RhinoDoc.ActiveDoc

# ==============================================================================
# Visualize
# ==============================================================================

# heights = cablenet.vertices_attribute('z')
# cmap = Colormap(heights, 'black')
# vertexcolor = {key: cmap(z) for key, z in zip(cablenet.vertices(), heights)}

# forces = cablenet.edges_attribute('f')
# cmap = Colormap(forces, 'rgb')
# edgecolor = {key: cmap(f) for key, f in zip(cablenet.edges(), forces)}

artist = CablenetArtist(cablenet, layer='cablenet')
artist.clear_layer()

vertices = artist.draw_vertices()
edges = artist.draw_edges()
faces = artist.draw_faces()
mesh = artist.draw_mesh()

artist.redraw()

# ==============================================================================
# Restore scriptcontext doc
# ==============================================================================

sc.doc = ghdoc
# ---------- end python_5 ----------
panel_7 = Panel(python_4.out)
faceb = FaceBoundaries(Mesh=python_5.faces)
tstat_3 = TreeStatistics(Tree=faceb)  # -> Paths, Length, Count
panel_8 = Panel(python_5.out)
smaller = SmallerThan(FirstNumber=tstat_3.Length, SecondNumber="1")  # -> SmallerThan, OrEqualTo
cull = CullPattern(List=python_5.faces, CullPattern=smaller.OrEqualTo)
wbjoin = WeaverbirdsJoinMeshesAndWeld(Mesh=cull, Weld=False)
geo = Geometry(python_5.stresses)
crv_14 = Curve(python_5.edges)
geo_2 = Geometry(python_5.reactions)
mesh = Mesh(python_5.mesh)
geo_3 = Geometry(python_5.forces)
data = Data(python_5.edge_keys)
data_2 = Data(python_5.cablenet)
mesh_2 = Mesh(wbjoin)
data_3 = Data(data_2)
panel_9 = Panel("0.015")
data_4 = Data(data_2)
data_5 = Data(data_2)
python_6 = GhPythonScript(cablenet=data_3)  # -> out, q, forces, radius
# ---------- python_6: Python ----------
forces = list(cablenet.edges_attribute('f'))
radius = list(cablenet.edges_attribute('r'))
q = list(cablenet.edges_attribute('q'))
# ---------- end python_6 ----------
python_7 = GhPythonScript(cablenet=data_4)  # -> out, longitudinal_lines, transversal_lines
# ---------- python_7: Python ----------
import rhinoscriptsyntax as rs

longitudinal_lines = []
transversal_lines = []

for edge in cablenet.edges():
    line = rs.AddLine(*cablenet.edge_coordinates(*edge))
    tag = cablenet.edge_attribute(edge, 'tag')
    if tag == 'long':
        longitudinal_lines.append(line)
    elif tag == 'trans':
        transversal_lines.append(line)
# ---------- end python_7 ----------
python_8 = GhPythonScript(cablenet=data_5, scale="0.025")  # -> out, lines, rrs, rxs, rys, rzs
# ---------- python_8: Python ----------
from compas.geometry import length_vector_sqrd
import rhinoscriptsyntax as rs

def interpolate_value(x, x0, x1, y0, y1):
    y = y0 + ((x - x0) * (y1 - y0) / (x1 - x0))
    return y
    

tol = 0.001

lines = []
rrs = []
rxs = []
rys = []
rzs = []
sps = []

for key, attr in cablenet.vertices(True):
    if not attr['is_anchor']:
        continue

    r = rx, ry, rz = cablenet.vertex_attributes(key, ('rx', 'ry', 'rz'))
    vec_length = length_vector_sqrd(r)

    if vec_length <= tol:
        continue

    sp = cablenet.vertex_coordinates(key)
    sps.append(sp)

    rxs.append(rx)
    rys.append(ry)
    rzs.append(rz)
    rrs.append(vec_length)


max_r = max(rrs)
min_r = min(rrs)


for sp, rx, ry, rz, r in zip(sps, rxs, rys, rzs, rrs):
    x, y, z = sp
    # scale = interpolate_value(r, min_r, max_r, tol, max_scale)
    # print('scale', scale)
    ep = x - scale * r * rx, y - scale * ry * r, z - scale * rz * r
    lines.append(rs.AddLine(sp, ep))
# ---------- end python_8 ----------
num_13 = Number(python_6.q)
num_14 = Number(python_8.rrs)
num_15 = Number(python_8.rxs)
crv_15 = Curve(python_8.lines)
num_16 = Number(python_6.forces)
num_17 = Number(python_8.rys)
num_18 = Number(python_6.radius)
num_19 = Number(python_8.rzs)
data_6 = Data(python_7.transversal_lines)
data_7 = Data(python_7.longitudinal_lines)

# ---- group: Mesh Curvature Analysis
mesh_3 = Mesh(mesh_2)
curvaturemode = ValueList({"Least": "min", "Most": "max", "Average": "mean"}, selected="Most")
negativeoff = BooleanToggle(True)
meshcurvature = MeshCurvatureAnalysis(Toggle=Toggle(False), Mesh=mesh_3, Mode=curvaturemode, Angle=Slider(45, range=0..360), NegativeOff=negativeoff)  # -> CMesh, Curvature, Colors, CurvatureSum, CurvatureBounds, CurvatureSorted, color_bounds; inputs Toggle: Boolean, Mesh: Mesh, NegativeOff: Boolean
# ---------- meshcurvature: Python ----------
"""
Analyse mesh curvature. Curvature is defined as the angle between a vertex normal
and the vector from this vertex to its neighbours. Zero curvature is thus equal 
to 90 degrees. However to evaluate positive and negative curvatures 90 is subtracted
from this value. Meaning that negative curvature will be a negative value and
positive curvature a positive value.
-
Name: MeshCurvature
Updated: 140818
Author: Anders Holden Deleuran (CITA/KADK)
Copyright: Creative Commons - Attribution 4.0 International
GitHub: www.github.com/AndersDeleuran/MeshAnalysis
Contact: adel@kadk.dk

    Args:
        Toggle: Activates the component.
        Mesh: The mesh to analyse.
        Mode: The curvature mode to calculate ("min","max" or "mean").
        Angle: The angle in degrees at which the mesh is unwelded.
        NegativeOff: If True negative curvature is treated as if positive.
    Returns:
        Mesh: A mesh colored by its curvature values.
        Curvature: The curvature values for each vertex.
        Colors: The curvature color for each vertex.
        CurvatureSum: The total curvature.
        CurvatureBounds: The minimum and maximum curvature.
        CurvatureSorted: Sorted curvature values (for graph mapping).
        MeshArea: The area of the mesh.
"""

import Rhino as rc
import math


# Set component name/nick
ghenv.Component.Name = "MeshCurvatureAnalysis"
ghenv.Component.NickName = "MeshCurvature"

def meshCurvature(mesh,mode,negativeOff):
    
    """ Calculate the curvature of a mesh using vertex normal angle 
    from each vertex to its neighbours """
    
    # Calculate mesh normals
    mesh.FaceNormals.ComputeFaceNormals()
    mesh.Normals.ComputeNormals()
    
    # Output list
    curvature = []
    
    # Iterate mesh vertices
    for i in range(mesh.Vertices.Count):
        
        # Get vertex, vertex normal and vertex neighbour IDs
        centerVertex = mesh.Vertices.Item[i]
        centerNormal = mesh.Normals.Item[i]
        neighbourIDs = mesh.Vertices.GetConnectedVertices(i)
        
        # Iterate neighbouring vertices
        angles = []
        for j in neighbourIDs:
            
            # Make vector from vertex to neighbour and check its length
            neighbourVertex = mesh.Vertices.Item[j]
            neighbourDirection = neighbourVertex - centerVertex
            if neighbourDirection.Length > 0:
                
                # Calculate angle between normal and new vector
                a = rc.Geometry.Vector3d.VectorAngle(centerNormal,neighbourDirection)
                
                # Subtract it from 90 and optionally get absolute value (no negative curvature)
                a = math.degrees(a) - 90
                if negativeOff:
                    a = abs(a)
                    
                # Add to list
                angles.append(a)
                
        # Calculate curvature depending on mode
        if mode == "min":
            curvature.append(min(angles))
            
        elif mode == "max":
            curvature.append(max(angles))
            
        elif mode == "mean":
            curvature.append(sum(angles)/len(angles))
            
    return curvature

def remapValues(values,targetMin,targetMax):
    
    """ Remap numbers into a new numeric domain """
    
    # Check that different values exist
    if len(set(values)) > 1:
        
        remappedValues = []
        
        # Get sourceDomain min and max
        srcMin = min(values)
        srcMax = max(values)
        
        # Iterate the values and remap them
        for v in values:
            rv = ((v-srcMin)/(srcMax-srcMin))*(targetMax-targetMin)+targetMin
            remappedValues.append(rv)
            
        return remappedValues
        
    # Else return targetMax for each value
    else:
        return [targetMin]*len(values)

def mapValueListAsColors(values):
    
    """ Make a list of HSL color where the values are mapped onto a
    0.0 - 0.7 hue domain. Meaning that low values will be red, medium
    values green and large values blue """
    
    colors = []
    remappedValues = remapValues(values,0.0,0.7)
    for v in remappedValues:
        c = rc.Display.ColorHSL(v,1.0,0.5).ToArgbColor()
        colors.append(c)
        
    return colors

def colorMesh(mesh,colors):
    """ Color mesh vertices by list of colors """
    for i,c in enumerate(colors):
        mesh.VertexColors.SetColor(i,c)

# Calls and GH output
if Toggle:
    if Mesh:
        
        # Unweld the mesh at sharp angles
        Mesh.Unweld(math.radians(Angle),True)
        
        # Calculate curvature, sorted values, sum etc,
        Curvature = meshCurvature(Mesh,Mode,NegativeOff)
        CurvatureSorted = sorted(Curvature)
        CurvatureSum = round(sum(Curvature),2)
        CurvatureBounds = (round(min(Curvature),2)),(round(max(Curvature),2))
        
        # Calculate colors and color mesh
        Colors = mapValueListAsColors(Curvature)
        CMesh = Mesh
        colorMesh(CMesh,Colors)
        color_bounds = mapValueListAsColors(list(range(10)))
# ---------- end meshcurvature ----------
panel_10 = Panel(meshcurvature.CurvatureBounds)
panel_11 = Panel(meshcurvature.CurvatureSum)
graph = QuickGraph(meshcurvature.CurvatureSorted, SortOrder=0)

# ----
clean = CombineClean(Meshes=mesh_3)
num_20 = Number(num_13)
bnd = Bounds(Numbers=num_20)
crv_16 = Curve(crv_15)
num_21 = Number(num_14)

crv_17 = Curve(crv_15)  # disabled
mesh_4 = Mesh(mesh_2)  # disabled
panel_12 = Panel("1.50")  # disabled
panel_13 = Panel("9")  # disabled
group = Group(Objects=crv_17)  # disabled
series_5 = Series(Start=0, Step=panel_12, Count=panel_13)  # disabled
Y = UnitY(Factor=series_5)  # disabled
move = Move(Geometry=mesh_4, Motion=Y)  # -> Geometry, Transform; disabled
move_2 = Move(Geometry=group, Motion=Y)  # -> Geometry, Transform; disabled
swatch = ColourSwatch(SwatchColor=RGB(204, 204, 204))  # disabled
mesh_5 = Mesh(move.Geometry)  # disabled
ungroup = Ungroup(Group=move_2.Geometry)  # disabled
preview = CustomPreview(Geometry=mesh_4, Material=swatch)  # disabled
crv_18 = Curve(ungroup)  # disabled

dedomain = DeconstructDomain(Domain=bnd)  # -> Start, End
end_3 = EndPoints(Curve=crv_16)  # -> Start, End
range = Range(Domain=bnd, Steps=10)
larger = LargerThan(FirstNumber=num_21, SecondNumber="1.0")  # -> LargerThan, OrEqualTo
vec2pt = Vector2Pt(PointA=end_3.Start, PointB=end_3.End, Unitize=False)  # -> Vector, Length
gradient = Gradient(
    LowerLimit=dedomain.End,
    UpperLimit=dedomain.Start,
    Parameter=num_20,
    stops=[0: RGB(255, 5, 5), 0.897: RGB(255, 255, 0), 0.948: RGB(0, 200, 255), 1: RGB(0, 34, 255)])
gradient_2 = Gradient(
    LowerLimit=dedomain.End,
    UpperLimit=dedomain.Start,
    Parameter=range,
    stops=[0: RGB(255, 5, 5), 0.365: RGB(255, 255, 0), 0.66: RGB(0, 200, 255), 1: RGB(0, 34, 255)])
mesh_6 = Mesh(meshcurvature.CMesh)
cull_2 = CullPattern(List=end_3.End, CullPattern=larger.LargerThan)
cull_3 = CullPattern(List=num_21, CullPattern=larger.LargerThan)
num_22 = Number(meshcurvature.CurvatureBounds)
col = Colour(meshcurvature.color_bounds)
eval = Evaluate(F="round(x, 4)", x=range)
eval_2 = Evaluate(F="round(x, 4)", x=cull_3)
swatch_2 = ColourSwatch(SwatchColor=RGB(138, 0, 0))
colour = Colour(gradient)
crv_19 = Curve(crv_14)
colour_2 = Colour(colour)
col_2 = Colour(col)  # disabled
num_23 = Number(num_22)  # disabled
vdisex = VectorDisplayEx(Point=end_3.Start, Vector=vec2pt.Vector, Colour=ColourSwatch(SwatchColor=RGB(26, 128, 0)), Width=2)
tag = TextTag(Location=cull_2, Text=eval_2, Colour=swatch_2)
tag_2 = TextTag(Location=cull_2, Text=eval_2, Colour=swatch_2)
previewlw = CustomPreviewLineweights(Geometry=crv_19, Shader=colour_2, Thickness="3", Absolute=False)
item_2 = ListItem(List=num_23, Index=0, Wrap=True)  # -> Item, Item1; disabled
panel_14 = Panel("9")  # disabled
dom = ConstructDomain(DomainStart=item_2.Item, DomainEnd=item_2.Item1)  # disabled
neg_3 = Negative(Value=Slider(9, range=0..10))
panel_15 = Panel("round(x, 3)")  # disabled
range_2 = Range(Domain=dom, Steps=panel_14)  # disabled
rad = Radians(Degrees=Slider(30, range=0..100))
pt_5 = ConstructPoint(XCoordinate=Slider(4.5, range=0..10), YCoordinate=neg_3, ZCoordinate=Slider(4, range=0..10))
eval_3 = Evaluate(F=panel_15, x=range_2)  # disabled
xz = XZPlane(Origin=pt_5)
rot3d = Rotate3D(Geometry=xz, Angle=rad, Center=pt_5, Axis=Vector(0, 0, 1))  # -> Geometry, Transform
rectangle = Rectangle(Plane=rot3d.Geometry, XSize=Domain(-1, 1), YSize=Domain(-2, 2), Radius=0)  # -> Rectangle, Length
area = Area(Geometry=rectangle.Rectangle)  # -> Area, Centroid
scale = Scale(Geometry=rectangle.Rectangle, Center=area.Centroid, Factor="0.6")  # -> Geometry, Transform
crv_20 = Curve(scale.Geometry)
crv_21 = Curve(crv_20)
legend = Legend(Colour=gradient_2, Tags=eval, Rectangle=crv_21, LegendType=1)

# ---- group: Mesh Drainage Path Analysis
mesh_7 = Mesh(mesh_2)

# ----
clean_2 = CombineClean(Meshes=mesh_7)

# ---- group: Mesh Drainage Path Analysis (continued)
meshdrainage = MeshDrainage(
    Toggle=Toggle(False),
    Mesh=clean_2,
    ParticleCount=Slider(1000, range=1..1000),
    MaxSteps=Slider(100, range=1..500),
    Tolerance=Slider(1, range=0..1),
    RandomSeed=Slider(10, range=0..100))  # -> DrainCurves, EndPoints; inputs Toggle: Boolean, Mesh: Mesh, ParticleCount: Int32, MaxSteps: Int32, RandomSeed: Int32
# ---------- meshdrainage: Python ----------
"""
Simulates drainage in order to analyse a mesh for local pooling of rain water and snow.
-
Name: MeshDrainageAnalysis
Updated: 140621
Author: Anders Holden Deleuran (CITA/KADK)
Copyright: Creative Commons - Attribution 4.0 International
GitHub: www.github.com/AndersDeleuran/MeshAnalysis
Contact: adel@kadk.dk

    Args:
        Toggle: Activates the component.
        Mesh: The mesh to analyse.
        ParticleCount: The amount of particles to simulate (randomly picked from the mesh vertices).
        MaxSteps: The amount steps to iteratively move the particles.
        Tolerance: The precision with which the particles are moved.
        RandomSeed: The random seed with which the particles are picked.
        
    Returns:
        DrainCurves: Curves constructed through the drain positions of each particle.
        EndPoints: The final position of the particles.
"""

import Rhino as rc
import random
import System.Threading.Tasks as tasks

# Set component name/nick
ghenv.Component.Name = "MeshDrainage"
ghenv.Component.NickName = "MeshDrainage"

def makeDrainMeshPaths(mesh,startPoints,maxSteps,tolerance):
    
    """ Estimates the trail of a drainage path on a mesh. Based on Benjamin 
    Golders concept and Remy's VB code found here:
    http://www.grasshopper3d.com/forum/topics/drainage-direction-script """
    
    # Return list
    drainPaths = []
    
    # Task function
    def drainPath(pt):
        
        # Particle list and current particle plane
        particles = []
        paPl = rc.Geometry.Plane(pt,rc.Geometry.Vector3d.ZAxis)
        
        for j in range(maxSteps):
            
            # Get the point on the mesh closest to the particle
            meshPt = mesh.ClosestMeshPoint(paPl.Origin,0.0)
            paPl = rc.Geometry.Plane(meshPt.Point,mesh.NormalAt(meshPt))
            
            # Check that first step has been taken and that current step is down slope
            if j and paPl.Origin.Z > particles[-1].Z:
                break
            else:
                # Add particle to list
                particles.append(paPl.Origin)
                
                # Move particle down slope
                an = rc.Geometry.Vector3d.VectorAngle(paPl.XAxis,-rc.Geometry.Vector3d.ZAxis,paPl)
                paPl.Rotate(an,paPl.ZAxis)
                paPl.Translate(paPl.XAxis*tolerance)
                
        # Make drain curve
        if len(particles) > 1:
            
            crv = rc.Geometry.Curve.CreateControlPointCurve(particles)
            drainPaths.append(crv)
            
    # Call task function
    tasks.Parallel.ForEach(startPoints,drainPath)
    
    return drainPaths

if Toggle and Mesh:
    
    # Get mesh vertices
    Vertices = Mesh.Vertices.ToPoint3dArray()
    
    # Pick random vertices
    if ParticleCount > len(Vertices):
        ParticleCount = len(Vertices)
    random.seed(RandomSeed)
    Vertices = random.sample(Vertices,ParticleCount)
    
    # Make drain curves
    DrainCurves = makeDrainMeshPaths(Mesh,Vertices,MaxSteps,Tolerance)
    EndPoints = [crv.PointAtEnd for crv in DrainCurves]
# ---------- end meshdrainage ----------

# ----
crv_22 = Curve(meshdrainage.DrainCurves)
preview_2 = CustomPreview(
    Geometry=crv_22,
    Material={diffuse=RGB(221, 160, 221), emission=RGB(66, 48, 66), shine=0.5, specular=RGB(255, 255, 255), transparency=0})
