# Grasshopper definition puerto_rico_series.gh (Grasshopper 1.0.7)
# plug-ins: Human

panel = Panel("""spine_left
spine_middle
spine_right""")
txt = Text(panel)
txt_2 = Text("anchors")
int = Integer(Slider(6, range=0..100))
int_2 = Integer(Slider(12, range=0..100))
num = Number(Slider(0.2, range=0..10))
txt_3 = Text(txt)
num_2 = Number(Slider(1, range=0..10))
txt_4 = Text(txt_2)
dpipeline = DynamicGeometryPipeline(
    LayerFilter=txt_3,
    TypeFilter="curve",
    NameFilter="*",
    GroupByLayer=False,
    GroupByType=False,
    IncludeHidden=True,
    IncludeLocked=True,
    enableFullPath=False,
    listenToAttributes=True)
dpipeline_2 = DynamicGeometryPipeline(
    LayerFilter=txt_4,
    TypeFilter="Point",
    NameFilter="*",
    GroupByLayer=False,
    GroupByType=False,
    IncludeHidden=True,
    IncludeLocked=True,
    enableFullPath=False,
    listenToAttributes=True)
pt = Point(dpipeline_2)
crv = Curve(dpipeline)
viewer = ParamViewer(dpipeline_2)
crv_2 = Curve(crv)
int_3 = Integer(int)
int_4 = Integer(int_2)
cp = ControlPoints(Curve=crv_2)  # -> Points, Weights, Knots
flip = FlipMatrix(Data=cp.Points)
pline = PolyLine(Vertices=flip, Closed=False)
explode = Explode(Curve=pline, Recursive=True)  # -> Segments, Vertices
divide = DivideCurve(Curve=explode.Segments, Count=int_3, Kinks=False)  # -> simplify(Points), Tangents, Parameters
graft = GraftTree(Tree=divide.Points, IncludeEmptyLists=True, IncludeNullItems=True)
path_mapper = PathMapper(graft, source="{A;B;C}", target="{B;C}")
pline_2 = PolyLine(Vertices=path_mapper, Closed=False)
divide_2 = DivideCurve(Curve=pline_2, Count=int_4, Kinks=False)  # -> simplify(Points), Tangents, Parameters
graft_2 = GraftTree(Tree=divide_2.Points, IncludeEmptyLists=True, IncludeNullItems=True)
pline_3 = PolyLine(Vertices=divide_2.Points, Closed=False)
path_mapper_2 = PathMapper(graft_2, source="{A;B;C}", target="{C;A}")
pline_4 = PolyLine(Vertices=path_mapper_2, Closed=False)
explode_2 = Explode(Curve=pline_3, Recursive=True)  # -> Segments, Vertices
explode_3 = Explode(Curve=pline_4, Recursive=True)  # -> Segments, Vertices
crv_3 = Curve(explode_2.Segments)
crv_4 = Curve(explode_3.Segments)
pt_2 = Point(cp.Points)
panel_2 = Panel("""long
trans""")
crv_5 = Curve(crv_3)
crv_6 = Curve(crv_4)
entwine = Entwine(Branch00=crv_5, Branch01=crv_6, FlattenInputs=True)
graft_3 = GraftTree(Tree=panel_2, IncludeEmptyLists=True, IncludeNullItems=True)
lng = ListLength(List=entwine)
flatten = FlattenTree(Tree=entwine, Path="{0}")
dup = DuplicateData(Data=graft_3, Number=lng, Order=True)  # -> flatten(Data)
python = GhPythonScript(run_proxy=Toggle(True), stop_server=Toggle(False))  # -> out, a; inputs run_proxy: Boolean, stop_server: Boolean
# ---------- python: Python ----------
from compas.rpc import Proxy
import scriptcontext as sc

import compas_fofin.fofin

if run_proxy:
    proxy = Proxy('compas_fofin.fofin')
    sc.sticky['fofin'] = proxy
    
    if stop_server:
        proxy.stop_server()
# ---------- end python ----------
crv_7 = Curve(flatten)
txt_5 = Text(dup)
crv_8 = Curve(crv_7)
num_3 = Number(num_2)
pt_3 = Point(pt_2)
pt_4 = Point(pt)
num_4 = Number(num)
txt_6 = Text(txt_5)
panel_3 = Panel(python.out)
end = EndPoints(Curve=crv_8)  # -> Start, End
flatten_2 = FlattenTree(Tree=pt_4, Path="{0}")
python_2 = GhPythonScript(x=end.Start, y=end.End)  # -> out, a; inputs x: list of Point3d, y: list of Point3d
# ---------- python_2: Python ----------
__author__ = "arpj"

import rhinoscriptsyntax as rs

a = []

for start, end in zip(x, y):
    start = [start.X, start.Y, start.Z]
    end = [end.X, end.Y, end.Z]
    a.append((start, end))
# ---------- end python_2 ----------
python_3 = GhPythonScript(x=flatten_2)  # -> out, a; inputs x: list of Point3d
# ---------- python_3: Python ----------
__author__ = "arpj"

import rhinoscriptsyntax as rs

a = []

for start in x:
    point = [start.X, start.Y, start.Z]
    a.append(point)
# ---------- end python_3 ----------
number_slider = Slider(5, range=0..10)
python_4 = GhPythonScript(lines=python_2.a, anchors=python_3.a, tags=txt_6, q_boundary=num_4, q_boundary_2=num_3)  # -> out, vertices, edges, faces, mesh, reactions, stresses, forces, cablenet; inputs lines: list, anchors: list, tags: list
# ---------- python_4: Python ----------
#!/usr/bin/env python
# -*- coding: utf-8 -*-

import os
import math
import compas
import Rhino
import rhinoscriptsyntax as rs

from compas.datastructures import Mesh
from compas.utilities import Colormap
from compas.utilities import geometric_key

from compas_fofin.datastructures import Cablenet
from compas_fofin.analysis import mesh_materialize_cables

from compas_fofin.fofin import update_xyz_proxy
from compas.rpc import Proxy
import compas_fofin.fofin

from compas_rhino.utilities import get_line_coordinates
from compas_rhino.utilities import get_point_coordinates

from compas_rhino.selectors import EdgeSelector
from compas_rhino.selectors import VertexSelector

from compas_fofin.rhino import CablenetArtist

from compas.geometry import angle_vectors
from compas.geometry import dot_vectors
from compas.geometry import distance_point_point
from compas.geometry import centroid_points

from compas_ghpython.artists import MeshArtist

import scriptcontext as sc

def edges_where_midpoints_in_rh_lines(struct, lines):
	lines = {geometric_key(rs.CurveMidPoint(line)): line for line in lines}
	edges = {geometric_key(struct.edge_midpoint(u, v)): (u, v) for u, v in struct.edges()}
	for gkey, ekey in edges.items():
		if lines.get(gkey) is not None:
			yield ekey

# ==============================================================================
# Call Proxy Locally
# ==============================================================================

fofin = sc.sticky['fofin']

# ==============================================================================
# Files IO
# ==============================================================================

# HERE = os.path.dirname(__file__)
# FILE_I = os.path.join(HERE, 'lines.json')
# FILE_O = os.path.join(HERE, 'hypar.json')

# ==============================================================================
# Create a cablenet from Rhino
# ==============================================================================

# lines = list(zip(get_point_coordinates(start), get_point_coordinates(end)))
# cablenet = Cablenet.from_lines(get_line_coordinates(lines), True)
cablenet = Cablenet.from_lines(lines, True)

# ==============================================================================
# Create a cablenet from Rhino
# ==============================================================================

max_num_vertices = 4
deletable = set()
for fkey in cablenet.faces():
    if distance_point_point(cablenet.face_centroid(fkey), [0, 0, 0]) > 0.10:
        continue
    
    deletable.add(fkey)

for fkey in deletable:
    cablenet.delete_face(fkey)
    
# ==============================================================================
# Set material density for self-weight
# ==============================================================================

cablenet.attributes['density'] = 0.

# ==============================================================================
# Preset tags
# ==============================================================================

midpoint_uv = {geometric_key(cablenet.edge_midpoint(*edge)): edge for edge in cablenet.edges()}
edges_found = []
for line in lines:
    edge = midpoint_uv[geometric_key(centroid_points(line))]
    edges_found.append(edge)

# ==============================================================================
# Set and move anchors
# ==============================================================================

gkey_key = cablenet.gkey_key()
for xyz in anchors:
    try:
        vkey = gkey_key[geometric_key(xyz)]
        cablenet.vertex_attributes(vkey, ['is_anchor', 'is_fixed'], [True, True])
    except KeyError:
        print(geometric_key(xyz), ' not found!')
    
# ==============================================================================
# Change Force Densities
# ==============================================================================

z_coords = [cablenet.edge_midpoint(u, v)[2] for u, v in cablenet.edges()]
z_max = max(z_coords)
z_min = min(z_coords)

for edge in cablenet.edges():
    cablenet.edge_attributes(edge, ['q'], [q_boundary])
    
for edge in cablenet.edges_on_boundary():      
    cablenet.edge_attributes(edge, ['q'], [q_boundary_2])
      

# ==============================================================================
# Apply point loads
# ==============================================================================

# for xyz in get_point_coordinates(rh_point_loads):
# 	vkey = gkey_key[geometric_key(xyz)]
# 	cablenet.vertex_attributes(vkey, ['py'], [0.6])

# ==============================================================================
# Compute equilibrium with Proxy
# ==============================================================================

data = fofin.update_xyz_proxy(cablenet.to_data())
cablenet = Cablenet.from_data(data)

# ==============================================================================
# Set tags
# ==============================================================================
for edge, tag in zip(edges_found, tags):
    cablenet.edge_attributes(edge, ['tag'], [tag])
    print(cablenet.edge_attribute(edge, 'hi'))
  
# ==============================================================================
# Assign radius to cables
# ==============================================================================

mesh_materialize_cables(cablenet)

# ==============================================================================
# Change scriptcontext doc
# ==============================================================================

sc.doc = Rhino.RhinoDoc.ActiveDoc

# ==============================================================================
# Visualize
# ==============================================================================

# heights = cablenet.vertices_attribute('z')
# cmap = Colormap(heights, 'black')
# vertexcolor = {key: cmap(z) for key, z in zip(cablenet.vertices(), heights)}

# forces = cablenet.edges_attribute('f')
# cmap = Colormap(forces, 'rgb')
# edgecolor = {key: cmap(f) for key, f in zip(cablenet.edges(), forces)}


# artist = MeshArtist(cablenet)
artist = CablenetArtist(cablenet, layer='cablenet')
artist.clear_layer()

vertices = artist.draw_vertices()
edges = artist.draw_edges()
faces = artist.draw_faces()
mesh = artist.draw_mesh()

# reactions = artist.draw_reactions()
# forces = artist.draw_forces(scale=0.05)
# stresses = artist.draw_stress(0.025)

artist.redraw()

# ==============================================================================
# Restore scriptcontext doc
# ==============================================================================

sc.doc = ghdoc

# ==============================================================================
# Export
# ==============================================================================

# cablenet.to_json(FILE_O)
# ---------- end python_4 ----------
panel_4 = Panel(python_2.out)
crv_9 = Curve(python_4.edges)
mesh = Mesh(python_4.mesh)
geo = Geometry(python_4.reactions)
geo_2 = Geometry(python_4.stresses)
geo_3 = Geometry(python_4.forces)
data = Data(python_4.cablenet)
item = ListItem(List=crv_9, Index=number_slider, Wrap=True)
item_2 = ListItem(List=crv_8, Index=number_slider, Wrap=True)
panel_5 = Panel(python_4.out)
mesh_2 = Mesh(mesh)
crv_10 = Curve(crv_9)
data_2 = Data(data)
data_3 = Data(data)
data_4 = Data(data)
preview = CustomPreview(Geometry=mesh_2, Material=ColourSwatch(SwatchColor=RGB(204, 204, 204)))  # disabled
python_5 = GhPythonScript(cablenet=data_2)  # -> out, q, forces, radius
# ---------- python_5: Python ----------
forces = list(cablenet.edges_attribute('f'))
radius = list(cablenet.edges_attribute('r'))
q = list(cablenet.edges_attribute('q'))
# ---------- end python_5 ----------
previewlw = CustomPreviewLineweights(Geometry=crv_10, Shader=ColourSwatch(SwatchColor=RGB(168, 168, 168)), Thickness="2", Absolute=False)
python_6 = GhPythonScript(cablenet=data_3)  # -> out, longitudinal_lines, transversal_lines
# ---------- python_6: Python ----------
import rhinoscriptsyntax as rs

longitudinal_lines = []
transversal_lines = []

for edge in cablenet.edges():
    line = rs.AddLine(*cablenet.edge_coordinates(*edge))
    tag = cablenet.edge_attribute(edge, 'tag')
    if tag == 'long':
        longitudinal_lines.append(line)
    elif tag == 'trans':
        transversal_lines.append(line)
# ---------- end python_6 ----------
python_7 = GhPythonScript(cablenet=data_4, scale="1.0")  # -> out, lines
# ---------- python_7: Python ----------
from compas.geometry import length_vector_sqrd
import rhinoscriptsyntax as rs

tol = 0.001

lines = []
for key, attr in cablenet.vertices(True):
    if not attr['is_anchor']:
        continue

    r = rx, ry, rz = cablenet.vertex_attributes(key, ('rx', 'ry', 'rz'))

    if length_vector_sqrd(r) <= tol:
        continue

    sp = x, y, z = cablenet.vertex_coordinates(key)
    ep = x - scale * rx, y - scale * ry, z - scale * rz
    
    lines.append(rs.AddLine(sp, ep))
# ---------- end python_7 ----------
panel_6 = Panel(python_7.out)
num_5 = Number(python_5.q)
crv_11 = Curve(python_7.lines)
num_6 = Number(python_5.forces)
num_7 = Number(python_5.radius)
data_5 = Data(python_6.transversal_lines)
data_6 = Data(python_6.longitudinal_lines)
data_7 = Data(data_5)
crv_12 = Curve(crv_11)
num_8 = Number(num_6)
end_2 = EndPoints(Curve=crv_12)  # -> Start, End
join = JoinCurves(Curves=data_7, Preserve=False)
bnd = Bounds(Numbers=num_8)
vdisex = VectorDisplayEx(Point=end_2.Start, Vector=crv_12, Colour=ColourSwatch(SwatchColor=RGB(87, 255, 41)), Width=2)
item_3 = ListItem(List=join, Index=0, Wrap=True)
remap = RemapNumbers(Value=num_8, Source=bnd, Target="1.0 to 0.0")  # -> Mapped, Clipped
dedomain = DeconstructDomain(Domain=bnd)  # -> Start, End
flip_2 = FlipCurve(Curve=join, Guide=item_3)  # -> Curve, Flag
gradient = Gradient(
    LowerLimit=0,
    UpperLimit=1,
    Parameter=remap.Mapped,
    stops=[0: RGB(255, 5, 5), 0.819: RGB(255, 255, 0), 0.949: RGB(0, 200, 255), 1: RGB(0, 34, 255)])
range = Range(Domain=bnd, Steps=10)
curvepoint = PointOnCurve(flip_2.Curve, parameter=0.5)
gradient_2 = Gradient(
    LowerLimit=dedomain.Start,
    UpperLimit=dedomain.End,
    Parameter=range,
    stops=[0: RGB(255, 5, 5), 0.365: RGB(255, 255, 0), 0.66: RGB(0, 200, 255), 1: RGB(0, 34, 255)])
pdecon = Deconstruct(Point=curvepoint)  # -> XComponent, YComponent, ZComponent
eval = Evaluate(F="round(x, 4)", x=range)
rectangle = Rectangle(Plane="{-2.5, 0.0, 0.0}", XSize=Domain(-1, 1), YSize=Domain(-2, 2), Radius=0)  # -> Rectangle, Length
colour = Colour(gradient)
sort = SortList(Keys=pdecon.XComponent, ValuesA=flip_2.Curve)  # -> Keys, ValuesA
concat = Concatenate(FragmentA=eval, FragmentB=" kN")
cp_2 = ControlPoints(Curve=sort.ValuesA)  # -> Points, Weights, Knots
legend = Legend(Colour=gradient_2, Tags=concat, Rectangle=rectangle.Rectangle, LegendType=1)
nurbs = NurbsCurve(Vertices=cp_2.Points, Degree=3, Periodic=False)  # -> flatten(Curve), Length, Domain
loft = Loft(Curves=nurbs.Curve, Options={Adjust=False, Closed=False, LoftEnds=0, LoftSimp=0, LoftType=0, Rebuild=10, Refit=0.01})
crv_13 = Curve(crv_9)
colour_2 = Colour(colour)
srf = Surface(loft)
previewlw_2 = CustomPreviewLineweights(Geometry=crv_13, Shader=colour_2, Thickness="3", Absolute=False)
mesh_3 = Mesh(mesh)
srf_2 = Surface(srf)
demesh = DeconstructMesh(Mesh=mesh_3)  # -> Vertices, Faces, Colours, Normals
createatts = CreateAttributes(Color=colour_2, enableFullPath=False)
srf_cp = SurfaceClosestPoint(Point=demesh.Vertices, Surface=srf_2)  # -> Point, UVPoint, Distance
bake = BakeGeometry(Bake=Button(), Geometry=crv_13, Attributes=createatts, DeleteOldBakes=False, PreserveTrees=False)
curvature = SurfaceCurvature(Surface=srf_2, Point=srf_cp.UVPoint)  # -> Frame, Gaussian, Mean
abs = Absolute(Value=curvature.Mean)
num_9 = Number(abs)
mesh_4 = Mesh(mesh)
data_8 = Data(num_9)
bnd_2 = Bounds(Numbers=data_8)
demesh_2 = DeconstructMesh(Mesh=mesh_4)  # -> Vertices, Faces, Colours, Normals
dedomain_2 = DeconstructDomain(Domain=bnd_2)  # -> Start, End
gradient_3 = Gradient(
    LowerLimit=dedomain_2.Start,
    UpperLimit=dedomain_2.End,
    Parameter=data_8,
    stops=[0: RGB(0, 128, 0), 0.0549: RGB(255, 255, 0), 0.353: RGB(255, 114, 33), 1: RGB(255, 0, 0)])
sort_2 = SortList(Keys=data_8)  # -> Keys, ValuesA
conmesh = ConstructMesh(Vertices=demesh_2.Vertices, Faces=demesh_2.Faces, Colours=gradient_3)
graph = QuickGraph(sort_2.Keys, SortOrder=0)
mesh_5 = Mesh(conmesh)
